# Grasshopper definition Robotic Wall.gh (Grasshopper 1.0.8)

# ---- group: Brick Dimensions
number_slider = Slider(32, range=0..100)
number_slider_2 = Slider(15.2, range=0..100)
number_slider_3 = Slider(9.85, range=0..100)

# ----
resolution_grid = Slider(2, range=0..10)
base_space_curve = Python3Script(
    x_bound=Slider(420, range=0..1000),
    y_bound=Slider(594, range=0..1000),
    offset_x=Slider(50, range=0..1000),
    offset_y=Slider(50, range=0..1000),
    division=Slider(150, range=0..1000))  # -> out, dwg_midpt, base, basecrv, crvpts, crvlines; inputs x_bound: Double, y_bound: Double, offset_x: Double, offset_y: Double, division: Int32
# ---------- base_space_curve: Python ----------
import Rhino.Geometry as rg

length = x_bound - 2*offset_x
height = y_bound - 2*offset_y
basept = rg.Point3d(offset_x, offset_y, 0.0)
base = rg.Rectangle3d(rg.Plane(rg.Point3d(0.0,0.0,0.0),rg.Vector3d.ZAxis),x_bound,y_bound)
base = base.ToNurbsCurve()

# 2. Drawing the Base Curve
dwg_midpt = rg.Point3d(x_bound/2, y_bound/2, 0.0)
basecrv = rg.Ellipse(
    rg.Plane(dwg_midpt,rg.Vector3d.ZAxis), 
    (length - 2*offset_x)/2, 
    (height - 2*offset_y)/2
    )
basecrv = basecrv.ToNurbsCurve()

# 3. Drawing the individual lines and points
basecrv.Domain = rg.Interval(0.0,1.0)
crvpts = [basecrv.PointAt(n/division) for n in range(division)]
ts = [n/division for n in range(division)]
print(ts)
print(type((crvpts[0])))
crvlines = [rg.Line(crvpts[i%division], crvpts[(i+1)%division]) for i, p in enumerate(crvpts)]
# ---------- end base_space_curve ----------
rad = Radians(Degrees=Slider(0, range=0..1000))
rad_2 = Radians(Degrees=Slider(30, range=0..1000))
crv = Curve(base_space_curve.base)
line = Line(base_space_curve.crvlines)

# ---- group: Restricts Length of the Curve
resolution_guide_curve = Slider(32, range=0..32)
length_line = LengthLine(Line=line, Strength=Slider(100, range=0..100))

# ---- group: Ensures that there is a distance between points
repelling_radii = Slider(32, range=0..50)
index = ItemIndex(List=line, Item=line)
series = Series(Start=0, Step=1, Count=Slider(3, range=0..10))
shift = ShiftList(List=index, Shift=1, Wrap=True)  # -> simplify(List)
line_2 = Line(line)
collider = Collider(Objects=line_2, Radii=repelling_radii, IgnoreA=index, IgnoreB=shift, Strength=Slider(10, range=0..100))

# ---- group: Angle Restriction for Curve
number_slider_4 = Slider(1000, range=0..1000)
shift_2 = ShiftList(List=line_2, Shift=1, Wrap=True)
angle = Angle(LineA=line_2, LineB=shift_2, RestAngle=Slider(10, range=0..100), Strength=number_slider_4)

# ----
boundary = BoundarySurfaces(Edges=base_space_curve.base)
dim = Dimensions(Surface=boundary)  # -> UDimension, VDimension
integer_division = IntegerDivision(A=dim.UDimension, B=resolution_grid)
integer_division_2 = IntegerDivision(A=dim.UDimension, B=resolution_grid)
clampangle = ClampAngle(LineA=line_2, LineB=shift_2, UpperLimit=rad_2, LowerLimit=rad, Strength=number_slider_4)
mesh_uv = MeshSurface(Surface=boundary, UCount=integer_division, VCount=integer_division_2, Overhang=True, Equalize=False)
demesh = DeconstructMesh(Mesh=mesh_uv)  # -> Vertices, Faces, Colours, Normals
onmesh = OnMesh(Points=base_space_curve.crvpts, Mesh=mesh_uv, Strength=Slider(100, range=0..100000))
merge = Merge(Data1=onmesh, Data2=length_line, Data3=collider, Data4=clampangle)  # -> flatten(Result)

bouncysolver = BouncySolver(
    GoalObjects=flatten(merge),
    Reset=Button(),
    Threshold=1e-15,
    Tolerance=0.0001,
    Damping=Slider(0.084, range=0..1),
    Iterations=10,
    On=Toggle(False))  # -> I, V, O
pt_internalised_from_bouncy_solver = Point([Point(420.0340932, 297, 0), Point(415.6662151, 315.8912833, 0), Point(403.5884874, 331.1065061, 0), Point(386.5691619, 340.4501832, 0), Point(367.50563, 343.9118764, 0), Point(348.1919623, 343.0846011, 0)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])

list = ValueList({"Config 1": 0, "Config 2": 1, "Config 3": 2}, selected="Config 1")
dam = DataDam(DataA=pt_internalised_from_bouncy_solver, BufferDelay=10000000, BufferMode=0)
brick_paths = Python3Script(
    pts=dam,
    work_pt=base_space_curve.dwg_midpt,
    no_layers=Slider(50, range=0..100),
    freq=Slider(1, range=0..10),
    deg=Slider(10, range=0..100),
    orientation=list)  # -> out, pts, t_v, profile, tree_pts, line_prof, profiles; inputs pts: list of Point3d, work_pt: Point3d, no_layers: Int32, freq: Int32, deg: Int32, orientation: Int32
# ---------- brick_paths: Python ----------
from compas_rhino.devtools import DevTools
DevTools.ensure_path()
DevTools.enable_reloader()

# 0. Import everything we will need
import math as m
import ghpythonlib.treehelpers as th
from compas_rhino.conversions import point_to_compas
from compas_rhino.geometry import RhinoNurbsCurve
from compas.geometry import Translation
from compas.geometry import Vector, Line
from compas.geometry import Frame
from brick_wall import Brick

# 0. Provide contextual definitions and set up essential variables
def remap(t, omin, omax, nmin, nmax):
    return (t-omin)/(omax-omin)*(nmax-nmin)+nmin

workspace_pt = point_to_compas(work_pt)

pts = [point_to_compas(pt) for pt in pts]
profile = RhinoNurbsCurve.from_points(pts, degree=deg, is_periodic=True)
result = [profile.closest_point(p, True) for p in pts]
cp, ct = list(zip(*result))
samplebrick = Brick()
samplebrick.configuration(orientation)

# 1. Setting up the main variables 
# a) Identify how far each point on curve is from the centre 
d_v = [Vector.from_start_end(p, workspace_pt) for p in cp]
for ddv in d_v:
    ddv.unitize()
# b) Generate essential tangent/normal vectors
t_v = [profile.tangent_at(t) for t in ct]
n_v = Vector.cross_vectors([Vector.Zaxis() for t in ct], t_v)
for n in n_v:
    n.unitize()
# c) Map vector values to possible offsets in subsequent curves
c_v = Vector.cross_vectors(t_v, d_v)
m_v = [mg.length for mg in c_v]
mg_v = [remap(m, min(m_v), max(m_v), 1, samplebrick.width) for m in m_v]
# d) Assign signs to the remapped values
s_v = [c.z / abs(c.z) if c.z != 0 else 1.0 for c in c_v]
amp_v = [s*m for (s,m) in zip(s_v,mg_v)]

# 2. Generating points per layer
# a) Establishing empty list to add point lists into
tree_pts = []
# tree_lines = []
for r in range(no_layers):
    # b1) Create copies of point list per layer
    copypts = [p.copy() for p in cp]
    # b2) Establish formula for calculating sinusoidal angle
    theta = r/(no_layers-1)*2*m.pi
    # b3) Assign force magnitude moving point dependent on position to centre and its index
    f_v = [amp*m.sin(freq*theta+(a)) for a, amp in enumerate(amp_v)]
    # b4) Apply force magnitude on unit normal vector assigned to each point
    m_v = [n*fv for (n,fv) in zip(n_v, f_v)]
    # b5) Translate each point by that force vector
    transf = [Translation.from_vector(v) for v in m_v]
    # b6) Translate each point by the height they belong to (change out list members)
    for p, pp in enumerate(copypts):
        pp.transform(transf[p])
        pp.z = r*samplebrick.height
    # sub_lines = [Line(copypts[ip%len(copypts)], copypts[(ip+1)%len(copypts)]) for ip, p in enumerate(copypts)]       
    # b7) Add new point list to tree_pts
    tree_pts.append(copypts)
    # tree_lines.append(sub_lines)

# 3. Creation of Curves
profiles = [RhinoNurbsCurve.from_points(p, degree=deg, is_periodic=True) for p in tree_pts]
profiles = th.list_to_tree(profiles)
# line_prof = th.list_to_tree(tree_lines)
tree_pts = th.list_to_tree(tree_pts)
# ---------- end brick_paths ----------
draw = COMPASDraw(cg=brick_paths.pts)  # -> rg
#   port cg: The COMPAS geometry or datastructure to be drawn.
#   port rg: The Rhino geometry object.
# ---------- draw: Python ----------
# r: compas>=2.14.1
"""
Draws COMPAS geometry in Grasshopper.
"""

from typing import Any

import Grasshopper

from compas.scene import SceneObject


class CompasToRhinoGeometry(Grasshopper.Kernel.GH_ScriptInstance):
    def RunScript(self, cg):
        if not cg:
            return None

        return SceneObject(item=cg).draw()
# ---------- end draw ----------
draw_2 = COMPASDraw(cg=brick_paths.t_v)  # -> rg; same code as draw
draw_3 = COMPASDraw(cg=brick_paths.profiles)  # -> rg; same code as draw
lng = ListLength(List=draw_3)
range = Range(Domain=Domain(0, 1), Steps=expr("x-1", lng))
graph = GraphMapper(
    range,
    x0=0,
    x1=1,
    y0=0,
    y1=1,
    container_name="Bezier",
    cpx=[0, 0.2521742582, 0.5108695626, 1],
    cpy=[0.2072464228, 0.4043477178, 0.09329712391, 0.07481873035])
bnd = Bounds(Numbers=graph)
dom = ConstructDomain(DomainStart=Slider(0.75, range=0..1), DomainEnd=1)
gap = Slider(5, range=0..10)
number_slider_5 = Slider(6, range=0..10)
crv_2 = Curve(reparameterize(draw_3))
xy = XYPlane(Origin=base_space_curve.dwg_midpt)
remap = RemapNumbers(Value=graph, Source=bnd, Target=dom)  # -> Mapped, Clipped
vdisex = VectorDisplayEx(Point=draw, Vector=draw_2, Colour=RGB(0, 0, 0), Width=Slider(13, range=0..100))
scale_nu = ScaleNU(Geometry=crv_2, Plane=xy, ScaleX=remap.Mapped, ScaleY=remap.Mapped, ScaleZ=1)  # -> Geometry, Transform
crv_3 = Curve(reparameterize(scale_nu.Geometry))
brick_wall = Python3Script(
    crv=crv_3,
    orientation=list,
    max_ang=Slider(0, range=0..100),
    gap=gap,
    mid_pt=base_space_curve.dwg_midpt,
    resolution=number_slider_5)  # -> out, param_list, rot_list, frames, samplebrick; inputs crv: list of Curve, max_ang: Double, gap: Double, mid_pt: Point3d, resolution: Int32
# ---------- brick_wall: Python ----------
# r: compas
# venv: mas-2627
from compas_rhino.devtools import DevTools
DevTools.ensure_path()
DevTools.enable_reloader()

# 0. Import everything we will need
import math as m
from compas_rhino.conversions import point_to_compas,curve_to_compas
import ghpythonlib.treehelpers as th
from compas.geometry import Polygon
from compas.geometry import Point, Vector
from compas.geometry import Frame

# ..also import our module "brick_wall.py", that needs to be in the same folder as our GH file
from brick_wall import Brick

# 0. Provide contextual definitions and set up essential variables
def remap(t, omin, omax, nmin, nmax):
    return (t-omin)/(omax-omin)*(nmax-nmin)+nmin

def radial_coverage(rotation, res, gap):
    return (diag/res) * m.cos(crit_ang - rotation) + gap/res


crv = [curve_to_compas(c) for c in crv]

mid_pt = point_to_compas(mid_pt)
frames = []

# 2.
samplebrick = Brick()
samplebrick.configuration(orientation)
rect = Polygon.from_rectangle(Point(0.0,0.0,0.0), samplebrick.length, samplebrick.width)
diag = 2 * rect.centroid.distance_to_point(rect.points[0])
crit_ang = m.acos(samplebrick.length/(diag))

param_list = []
rot_list = []

for r in crv:
    t = 0.0
    sub_t, sub_rot, sub_frm = ([] for i in range(3))
    while t < 1:
        target_pt = r.point_at(t)
        tangent_v = r.tangent_at(t)
        frame_v = Frame(target_pt, tangent_v, Vector.cross(Vector.Zaxis(), tangent_v))
        direct_v = mid_pt - target_pt
        direct_v.z = 0.0
        direct_v.unitize()
        mag = Vector.cross(tangent_v, direct_v).z
        rot_mag = m.copysign(remap(1 - abs(mag), 0.0, 1.0, 0.0, m.radians(max_ang)), mag)
        print(rot_mag)
        rad = radial_coverage(rot_mag, res = resolution, gap = gap)
        frame_v.rotate(rot_mag, Vector.Zaxis(), target_pt)

        sub_t.append(t)
        sub_rot.append(rot_mag)
        sub_frm.append(frame_v)

        t0, t1 = t, t
        while t1 < 1 and r.point_at(t1).distance_to_point(target_pt) <= rad:
            t0, t1 = t1, min(t1 + 1.0 / 2000, 1.0)
        if r.point_at(t1).distance_to_point(target_pt) <= rad:
            break                           
        for _ in range(30):
            tm = 0.5 * (t0 + t1)
            if r.point_at(tm).distance_to_point(target_pt) <= rad:
                t0 = tm
            else:
                t1 = tm
        t = t1

    param_list.append(sub_t)
    rot_list.append(sub_rot)
    frames.append(sub_frm)

param_list = th.list_to_tree(param_list)
rot_list = th.list_to_tree(rot_list)
frames = th.list_to_tree(frames)
# ---------- end brick_wall ----------
frame_culling = Python3Script(frames=brick_wall.frames, samplebrick=brick_wall.samplebrick, resolution=number_slider_5, gap=gap)  # -> out, sel_frames; inputs frames: tree, resolution: Int32, gap: Double
# ---------- frame_culling: Python ----------
# r: compas
# venv: mas-2627
from compas_rhino.devtools import DevTools
DevTools.ensure_path()

# 0. Import everything we will need
import math as m
from compas_rhino.conversions import point_to_compas,curve_to_compas
import ghpythonlib.treehelpers as th
from compas.geometry import Polygon
from compas.geometry import Point, Vector
from compas.geometry import Frame

from brick_wall import Brick

def clash(f1, f2, size_x, size_y):
    """True if two bricks (frames f1, f2; size_x x size_y each, in plan) overlap. Separating axis test."""
    d = f2.point - f1.point
    for ax in (f1.xaxis, f1.yaxis, f2.xaxis, f2.yaxis):
        reach = sum(size_x/2 * abs(ax.dot(f.xaxis)) + size_y/2 * abs(ax.dot(f.yaxis)) for f in (f1, f2))
        if abs(d.dot(ax)) >= reach:
            return False
    return True

frames = th.tree_to_list(frames)
size_x = samplebrick.length + gap
size_y = samplebrick.width + gap

sel_frames = []
for i, f in enumerate(frames):
    sub_sel_frames = []
    for g in f[i % resolution:]:
        if not any(clash(k, g, size_x, size_y) for k in sub_sel_frames):
            sub_sel_frames.append(g)
    while len(sub_sel_frames) > 2 and clash(sub_sel_frames[-1], sub_sel_frames[0], size_x, size_y):
        sub_sel_frames.pop()
    sel_frames.append(sub_sel_frames)
sel_frames = th.list_to_tree(sel_frames)
# ---------- end frame_culling ----------
brick_drawing = Python3Script(frames=frame_culling.sel_frames, samplebrick=brick_wall.samplebrick)  # -> out, draw_bricks; inputs frames: tree
# ---------- brick_drawing: Python ----------
# r: compas
# venv: mas-2627
from compas_rhino.devtools import DevTools
DevTools.ensure_path()

# 0. Import everything we will need
import math as m
from compas_rhino.conversions import point_to_compas,curve_to_compas
import ghpythonlib.treehelpers as th
from compas.geometry import Polygon
from compas.geometry import Point, Vector
from compas.geometry import Frame

from brick_wall import Brick

frames = th.tree_to_list(frames)

bricks = []
for sel_f in frames:
    sub_bricks = []
    for sel_b in sel_f:
        b = Brick(sel_b)
        b.configuration(samplebrick.get_config())
        sub_bricks.append(b)
    bricks.append(sub_bricks)

draw_bricks = [[brick.draw() for brick in sb] for sb in bricks]
draw_bricks = th.list_to_tree(draw_bricks)
# ---------- end brick_drawing ----------
draw_4 = COMPASDraw(cg=brick_drawing.draw_bricks)  # -> rg; same code as draw
