# Grasshopper definition design_weijiun.gh (Grasshopper 1.0.8)
# plug-ins: Pufferfish, Parakeet, Bifocals

# ---- group: This is needed only ONCE in the GH definition
enable_auto_reload = Python3Script()  # -> ok
# ---------- enable_auto_reload: Python ----------
"""
------------------------------
Using VS Code as Python editor
------------------------------

The simplest way to start using VS Code as our editor, is
to place our Python code in files located IN THE SAME FOLDER as our Grasshopper file.

After we have done that, we need 2 steps: 

1. Enable the COMPAS reloader on one component. This tells Grasshopper to watch for changes in the Pythoh files and reload if changed.
2. Every other component that uses Python code from external files needs to start with a method to ensure Grasshopper knows where to load the files from.

"""
# r: compas
# venv: mas-2627

from compas_rhino.devtools import DevTools
DevTools.enable_reloader()
# ---------- end enable_auto_reload ----------

# ---- group: object_position_on_printbed
# 校正桌面 + 物件位置: bed corners (robot base, mm), uv on the bed, angle, first layer offset
# 校正桌面 + 物件位置: bed corners (robot base, mm), uv on the bed, angle, first layer offset
number_slider = Slider(0.5, range=0..1)
pt = ConstructPoint(XCoordinate=number_slider, YCoordinate=Slider(0.5, range=0..1), ZCoordinate=0)

# ---- group: object_rotation
number_slider_2 = Slider(75, range=0..360)

# ---- group: DESIGN
point_spacing_mm = Slider(6, range=1..50)
layer_height_mm = Slider(1, range=0.5..10)
height_mm = Slider(50, range=1..500)
radius_mm = Slider(50, range=5..200)

center_x_mm = Slider(0, range=-500..500)
center_y_mm = Slider(0, range=-500..500)
fine_adjust_z_mm = Slider(0, range=-5..5)

# ---- group: ② 新電池 (Python，取代 TACO)
# SHORT-0
data = Data(Tree({0}: [Point(1040.048509, 1349.291679, 1), Point(1043.549707, 1358.554695, 1), Point(1047.100916, 1367.798743, 1), Point(1050.600199, 1377.062567, 1), Point(1054.228227, 1386.276501, 1), Point(1057.387147, 1395.654701, 1)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], {1}: [Point(1004.455306, 1603.814151, 5), Point(1006.860015, 1594.979213, 5), Point(1007.775708, 1591.614944, 5), Point(1017.042407, 1590.751148, 5), Point(1026.309107, 1589.887352, 5), Point(1035.575807, 1589.023556, 5)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], {2}: [Point(1012.951897, 1484.693137, 5), Point(1012.542638, 1476.505628, 5), Point(1012.133379, 1468.318118, 5), Point(1012.586394, 1468.268223, 5), Point(1021.000095, 1467.341539, 5), Point(1029.413797, 1466.414855, 5)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], {3}: [Point(1017.153301, 1343.583086, 5), Point(1025.568816, 1342.55994, 5), Point(1033.984331, 1341.536793, 5), Point(1037.235067, 1350.097206, 5), Point(1040.485802, 1358.657619, 5), Point(1043.736538, 1367.218032, 5)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], {4}: [Point(955.6176886, 1238.700968, 5), Point(962.1525361, 1237.284688, 5), Point(968.6873837, 1235.868408, 5), Point(973.873302, 1243.214767, 5), Point(979.0592203, 1250.561126, 5), Point(984.2451386, 1257.907485, 5)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]))

# SHORT-10
data_2 = Data(Tree({0}: [Point(2565.530408, 1505.965362, 1), Point(2564.716708, 1496.061264, 1), Point(2563.904073, 1486.157078, 1), Point(2563.089761, 1476.253028, 1), Point(2562.24257, 1466.35176, 1), Point(2561.34161, 1456.45522, 1)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], {1}: [Point(2772.933286, 1223.337744, 5), Point(2769.233872, 1228.868066, 5), Point(2765.534458, 1234.398389, 5), Point(2764.172794, 1236.45244, 5), Point(2757.118246, 1231.77668, 5), Point(2750.063699, 1227.10092, 5)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], {2}: [Point(2574.250097, 1603.2273, 5), Point(2574.049702, 1593.863994, 5), Point(2573.849306, 1584.500689, 5), Point(2573.760167, 1581.180627, 5), Point(2573.747683, 1580.715636, 5), Point(2577.270146, 1581.337006, 5)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], {3}: [Point(2692.221215, 1327.395872, 5), Point(2687.262537, 1333.146834, 5), Point(2682.303859, 1338.897796, 5), Point(2677.345181, 1344.648758, 5), Point(2668.556484, 1340.747965, 5), Point(2659.767787, 1336.847171, 5)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], {4}: [Point(2581.643377, 1483.670586, 5), Point(2574.173823, 1481.616421, 5), Point(2566.70427, 1479.562257, 5), Point(2565.724033, 1470.264977, 5), Point(2564.743795, 1460.967697, 5), Point(2563.763558, 1451.670417, 5)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]))

# SHORT-2
data_3 = Data(Tree({0}: [Point(1352.317088, 1351.376042, 1), Point(1354.966548, 1360.946093, 1), Point(1356.787147, 1370.711912, 1), Point(1358.594168, 1380.481034, 1), Point(1360.408063, 1390.248918, 1), Point(1362.214365, 1400.018141, 1)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], {1}: [Point(1314.739684, 1612.530807, 5), Point(1316.535011, 1602.803809, 5), Point(1316.565988, 1602.615453, 5), Point(1316.713027, 1602.605022, 5), Point(1326.221508, 1601.930497, 5), Point(1335.729989, 1601.255973, 5)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], {2}: [Point(1312.110797, 1501.098091, 5), Point(1311.031275, 1493.242642, 5), Point(1309.951754, 1485.387192, 5), Point(1309.354857, 1481.347619, 5), Point(1312.019443, 1481.184242, 5), Point(1314.146428, 1481.053827, 5)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], {3}: [Point(1303.343939, 1376.100971, 5), Point(1302.048569, 1367.51949, 5), Point(1300.753198, 1358.938009, 5), Point(1302.122659, 1358.828241, 5), Point(1304.133873, 1358.667033, 5), Point(1313.392512, 1358.016609, 5)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], {4}: [Point(1292.906941, 1257.395362, 5), Point(1299.918751, 1256.417312, 5), Point(1306.93056, 1255.439262, 5), Point(1311.499561, 1264.104742, 5), Point(1316.068562, 1272.770222, 5), Point(1320.637563, 1281.435702, 5)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]))

# SHORT-11
data_4 = Data(Tree({0}: [Point(2726.233119, 1485.009256, 1), Point(2725.652336, 1475.036224, 1), Point(2725.074171, 1465.063039, 1), Point(2724.542441, 1455.087298, 1), Point(2724.114922, 1445.106594, 1), Point(2723.830398, 1435.1208, 1)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], {1}: [Point(2927.483213, 1247.379693, 5), Point(2922.147731, 1252.916733, 5), Point(2916.812249, 1258.453772, 5), Point(2911.476768, 1263.990812, 5), Point(2904.044127, 1258.939409, 5), Point(2896.611487, 1253.888006, 5)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], {2}: [Point(2802.570904, 1365.847094, 5), Point(2795.692907, 1371.985143, 5), Point(2788.814911, 1378.123193, 5), Point(2781.936914, 1384.261243, 5), Point(2773.01551, 1380.190276, 5), Point(2764.094105, 1376.119309, 5)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], {3}: [Point(2734.015763, 1660.897161, 5), Point(2734.139532, 1653.401451, 5), Point(2734.263301, 1645.90574, 5), Point(2734.292367, 1643.052825, 5), Point(2734.301429, 1642.163432, 5), Point(2737.91263, 1642.529608, 5)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], {4}: [Point(2748.05364, 1553.652618, 5), Point(2740.408567, 1552.030828, 5), Point(2732.763494, 1550.409038, 5), Point(2732.338067, 1541.339156, 5), Point(2731.912639, 1532.269273, 5), Point(2731.487212, 1523.199391, 5)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]))

# SHORT-1
data_5 = Data(Tree({0}: [Point(1193.466413, 1345.956397, 1), Point(1196.313477, 1355.421529, 1), Point(1198.963017, 1364.951913, 1), Point(1201.710643, 1374.45517, 1), Point(1204.39969, 1383.97522, 1), Point(1207.172883, 1393.471069, 1)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], {1}: [Point(1144.757497, 1663.222255, 5), Point(1146.757799, 1657.611507, 5), Point(1148.907517, 1651.581653, 5), Point(1157.548662, 1651.162872, 5), Point(1166.189806, 1650.74409, 5), Point(1174.830951, 1650.325309, 5)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], {2}: [Point(1164.719841, 1554.177165, 5), Point(1165.129107, 1546.915242, 5), Point(1165.538372, 1539.653319, 5), Point(1165.590459, 1538.088559, 5), Point(1168.063904, 1537.85037, 5), Point(1177.485212, 1536.943113, 5)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], {3}: [Point(1155.770768, 1430.547827, 5), Point(1154.93031, 1421.685128, 5), Point(1154.089851, 1412.822429, 5), Point(1156.399878, 1412.589634, 5), Point(1158.936079, 1412.334047, 5), Point(1168.568678, 1411.465922, 5)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], {4}: [Point(1151.533005, 1297.504436, 5), Point(1159.11848, 1296.5353, 5), Point(1166.703955, 1295.566164, 5), Point(1170.468796, 1303.509483, 5), Point(1174.233637, 1311.452802, 5), Point(1177.998478, 1319.396122, 5)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]))

# ---- group: NOZZLE WIDTH
number_slider_3 = Slider(3, range=0..100)  # disabled

# ---- group: ② 新電池 (Python，取代 TACO)
# SHORT-3
data_6 = Data(Tree({0}: [Point(1515.821642, 1357.03527, 1), Point(1517.585723, 1366.589285, 1), Point(1518.429648, 1376.271147, 1), Point(1519.134424, 1385.965719, 1), Point(1519.880367, 1395.657357, 1), Point(1520.595471, 1405.351314, 1)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], {1}: [Point(1461.925007, 1666.147017, 5), Point(1463.682678, 1660.167217, 5), Point(1464.623516, 1656.966376, 5), Point(1473.43989, 1656.673068, 5), Point(1482.256264, 1656.379759, 5), Point(1491.072638, 1656.08645, 5)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], {2}: [Point(1471.751545, 1565.109129, 5), Point(1471.513313, 1557.638209, 5), Point(1471.275081, 1550.16729, 5), Point(1471.201423, 1548.608149, 5), Point(1473.083364, 1548.509587, 5), Point(1474.622609, 1548.431109, 5)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], {3}: [Point(1463.299418, 1439.339504, 5), Point(1463.907255, 1432.456269, 5), Point(1464.515092, 1425.573035, 5), Point(1464.964301, 1420.48613, 5), Point(1474.708945, 1420.207492, 5), Point(1484.453588, 1419.928854, 5)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], {4}: [Point(1457.217544, 1325.159134, 5), Point(1455.451891, 1317.299816, 5), Point(1453.686239, 1309.440499, 5), Point(1454.549862, 1309.397575, 5), Point(1456.970521, 1309.277265, 5), Point(1465.624259, 1308.939432, 5)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]))

# SHORT-9
data_7 = Data(Tree({0}: [Point(2407.955492, 1542.79519, 1), Point(2406.897073, 1532.919369, 1), Point(2405.872139, 1523.040009, 1), Point(2404.838137, 1513.161597, 1), Point(2403.803062, 1503.283299, 1), Point(2402.76646, 1493.405158, 1)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], {1}: [Point(2415.115987, 1663.666048, 5), Point(2415.598071, 1654.399797, 5), Point(2415.6685, 1652.579973, 5), Point(2415.684863, 1652.157181, 5), Point(2418.270334, 1652.348161, 5), Point(2426.822459, 1652.909326, 5)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], {2}: [Point(2555.184089, 1288.297592, 5), Point(2552.483497, 1292.978104, 5), Point(2549.608393, 1297.961069, 5), Point(2546.733289, 1302.944034, 5), Point(2545.490539, 1305.149893, 5), Point(2537.116417, 1301.491959, 5)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], {3}: [Point(2430.113894, 1577.553502, 5), Point(2422.024724, 1576.315815, 5), Point(2413.935555, 1575.078129, 5), Point(2413.149341, 1565.943339, 5), Point(2412.363127, 1556.808548, 5), Point(2411.576913, 1547.673758, 5)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], {4}: [Point(2471.389775, 1409.221259, 5), Point(2467.275808, 1414.525776, 5), Point(2461.616894, 1421.822334, 5), Point(2455.95798, 1429.118892, 5), Point(2447.897783, 1426.793204, 5), Point(2439.837586, 1424.467515, 5)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]))

# SHORT-8
data_8 = Data(Tree({0}: [Point(2360.879347, 1340.862187, 1), Point(2356.81553, 1349.734592, 1), Point(2352.013187, 1358.232274, 1), Point(2347.23981, 1366.747015, 1), Point(2342.488977, 1375.274484, 1), Point(2337.714884, 1383.788973, 1)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], {1}: [Point(2257.019022, 1617.421346, 5), Point(2256.935622, 1609.486421, 5), Point(2256.852221, 1601.551496, 5), Point(2256.804364, 1599.256539, 5), Point(2257.335228, 1599.312438, 5), Point(2259.374695, 1599.527191, 5)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], {2}: [Point(2264.693947, 1514.738026, 5), Point(2256.46579, 1513.343162, 5), Point(2248.237633, 1511.948298, 5), Point(2246.718002, 1502.569832, 5), Point(2245.198371, 1493.191366, 5), Point(2243.678739, 1483.812901, 5)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], {3}: [Point(2346.223696, 1361.565208, 5), Point(2343.250778, 1367.175223, 5), Point(2339.889761, 1373.517599, 5), Point(2336.528743, 1379.859975, 5), Point(2327.151929, 1377.228254, 5), Point(2317.775115, 1374.596532, 5)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], {4}: [Point(2390.538888, 1256.815628, 5), Point(2388.675742, 1263.179868, 5), Point(2386.896813, 1269.256434, 5), Point(2386.577053, 1270.369332, 5), Point(2385.169428, 1269.815503, 5), Point(2377.036021, 1266.550577, 5)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]))

# SHORT-5
data_9 = Data(Tree({0}: [Point(1850.529955, 1349.876834, 1), Point(1850.428994, 1359.824924, 1), Point(1850.031243, 1369.762718, 1), Point(1848.71652, 1379.621114, 1), Point(1847.063718, 1389.431482, 1), Point(1845.473805, 1399.252306, 1)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], {1}: [Point(1779.676504, 1667.686928, 5), Point(1781.240527, 1660.812454, 5), Point(1781.502889, 1659.659273, 5), Point(1790.427239, 1659.616737, 5), Point(1799.351589, 1659.574202, 5), Point(1808.275939, 1659.531666, 5)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], {2}: [Point(1783.184452, 1568.716878, 5), Point(1782.528794, 1560.460012, 5), Point(1781.873135, 1552.203145, 5), Point(1781.680646, 1550.044569, 5), Point(1783.383098, 1550.084028, 5), Point(1784.175756, 1550.1024, 5)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], {3}: [Point(1830.501497, 1451.867445, 5), Point(1828.721806, 1458.831767, 5), Point(1826.942115, 1465.79609, 5), Point(1826.869226, 1466.106289, 5), Point(1825.844224, 1470.468446, 5), Point(1817.485448, 1470.005065, 5)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], {4}: [Point(1847.759225, 1331.250893, 5), Point(1847.915617, 1338.720599, 5), Point(1848.072008, 1346.190304, 5), Point(1848.088879, 1346.663952, 5), Point(1847.474895, 1346.601594, 5), Point(1845.870001, 1346.438273, 5)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]))

# SHORT-4
data_10 = Data(Tree({0}: [Point(1681.633487, 1354.389788, 1), Point(1682.918372, 1364.095324, 1), Point(1683.265989, 1373.858903, 1), Point(1682.730312, 1383.634326, 1), Point(1682.349966, 1393.417736, 1), Point(1681.942037, 1403.200095, 1)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], {1}: [Point(1627.875423, 1619.32553, 5), Point(1628.88332, 1609.700941, 5), Point(1628.907683, 1609.416562, 5), Point(1632.214558, 1609.333608, 5), Point(1641.164902, 1609.109087, 5), Point(1650.115245, 1608.884565, 5)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], {2}: [Point(1618.76955, 1506.888496, 5), Point(1617.236979, 1498.405507, 5), Point(1615.704409, 1489.922519, 5), Point(1614.846224, 1485.193262, 5), Point(1620.07884, 1485.308457, 5), Point(1620.918761, 1485.310833, 5)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], {3}: [Point(1628.983345, 1374.787412, 5), Point(1629.656762, 1365.045677, 5), Point(1630.019203, 1359.802552, 5), Point(1632.114985, 1359.875715, 5), Point(1641.614513, 1360.184505, 5), Point(1651.11404, 1360.493296, 5)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], {4}: [Point(1619.349856, 1276.345767, 5), Point(1616.965133, 1266.966704, 5), Point(1616.403676, 1264.420315, 5), Point(1619.278099, 1264.431014, 5), Point(1619.737716, 1264.432724, 5), Point(1627.746067, 1264.525408, 5)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]))

# SHORT-7
data_11 = Data(Tree({0}: [Point(2190.235093, 1346.406332, 1), Point(2187.544379, 1356.012389, 1), Point(2184.116269, 1365.371878, 1), Point(2180.170119, 1374.533928, 1), Point(2176.357931, 1383.752778, 1), Point(2172.494264, 1392.95018, 1)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], {1}: [Point(2097.17153, 1666.918196, 5), Point(2098.234712, 1658.888106, 5), Point(2098.326098, 1658.197882, 5), Point(2107.185779, 1658.456834, 5), Point(2116.04546, 1658.715785, 5), Point(2124.90514, 1658.974736, 5)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], {2}: [Point(2195.182139, 1318.621539, 5), Point(2193.120927, 1326.784146, 5), Point(2191.98213, 1331.293897, 5), Point(2191.665682, 1332.624558, 5), Point(2182.612409, 1330.347842, 5), Point(2173.559135, 1328.071126, 5)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], {3}: [Point(2095.679631, 1560.899457, 5), Point(2094.775671, 1551.73264, 5), Point(2093.871711, 1542.565823, 5), Point(2093.548886, 1539.529059, 5), Point(2093.998854, 1539.578213, 5), Point(2096.716273, 1539.875056, 5)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], {4}: [Point(2146.623543, 1440.283044, 5), Point(2142.736233, 1448.172731, 5), Point(2140.411927, 1452.890144, 5), Point(2138.127497, 1457.850382, 5), Point(2129.880642, 1456.508026, 5), Point(2121.633786, 1455.16567, 5)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]))

# SHORT-6
data_12 = Data(Tree({0}: [Point(2020.167152, 1350.334199, 1), Point(2018.753376, 1359.969425, 1), Point(2016.864064, 1369.519974, 1), Point(2014.262468, 1378.903244, 1), Point(2011.545542, 1388.254945, 1), Point(2008.858439, 1397.615325, 1)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], {1}: [Point(1941.927652, 1623.64717, 5), Point(1942.172372, 1616.77086, 5), Point(1942.417091, 1609.89455, 5), Point(1942.441268, 1608.759727, 5), Point(1943.872647, 1608.813113, 5), Point(1944.156279, 1608.823138, 5)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], {2}: [Point(1952.699872, 1531.98562, 5), Point(1943.838834, 1531.334729, 5), Point(1934.977797, 1530.683839, 5), Point(1933.419565, 1522.350181, 5), Point(1931.861334, 1514.016524, 5), Point(1930.303102, 1505.682866, 5)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], {3}: [Point(2008.830779, 1385.147048, 5), Point(2006.514168, 1394.131111, 5), Point(2005.461897, 1398.211927, 5), Point(2004.906525, 1400.471248, 5), Point(1995.151445, 1399.080518, 5), Point(1985.396364, 1397.689787, 5)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], {4}: [Point(2023.004858, 1277.938118, 5), Point(2023.172471, 1284.602756, 5), Point(2023.340084, 1291.267394, 5), Point(2023.35148, 1291.694364, 5), Point(2022.805609, 1291.589053, 5), Point(2022.209367, 1291.47096, 5)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]))

# ---- group: printbed_position
printbed_position = _4PointSurface(
    CornerA="1556.32,-951.12,-368.97",
    CornerB="1517.62,989.35,-360.76",
    CornerC="575.35,990.12,-365.06",
    CornerD="595.68,-963.48,-379.78")

# ----
pt_2 = ConstructPoint(XCoordinate=Slider(0.5, range=0..1), YCoordinate=Slider(0.5, range=0..1), ZCoordinate=0)

# ---- group: ② 新電池 (Python，取代 TACO) / 物件旋轉
number_slider_4 = Slider(75, range=0..360)

# ----
lamcp_bridge = LAMCPBridge(enable=Toggle(True))  # -> status; inputs enable: Boolean, port: Int32
#   port enable: Toggle to start (True) or stop (False) the local HTTP server.
#   port port: Port to listen on (loopback only). Defaults to 8765.
#   port status: Current server status string.
# ---------- lamcp_bridge: Python ----------
"""
LAMCP Bridge: local HTTP server inside Rhino 8 / Grasshopper CPython.

Exposes `POST /exec` (JSON: `{"code": "...", "timeout": 30}`) which
exec()s `code` and returns
`{"stdout": "...", "stderr": "...", "result": "...", "error": null|str}`.

Pair with the `lamcp` FastMCP server, which translates Claude's
`run_python_script` MCP tool calls into POSTs to this endpoint.

Binds to 127.0.0.1 only. NEVER expose beyond localhost â€” it exec()s
arbitrary Python with full Rhino API access.

LAMCP v0.1.0
"""

import contextlib
import io
import json
import threading
import traceback
from http.server import BaseHTTPRequestHandler
from http.server import HTTPServer

import Grasshopper
import scriptcontext as sc


SHARED_GLOBALS_KEY = "_lamcp_bridge_globals"
SERVER_KEY = "_lamcp_bridge_server"


def _exec_code(code, timeout):
    """Run `code` on the HTTP-server thread and capture stdout/stderr/result.

    NOTE: this is intentionally NOT marshalled to Rhino's UI thread for the
    spike â€” `Rhino.RhinoApp.InvokeOnUiThread` was queueing actions that
    never fired in Rhino 8 CPython. Most read-only RhinoCommon access is
    safe cross-thread; mutations may crash. Add Eto-based marshalling
    back here when we need it.
    """
    out = io.StringIO()
    err = io.StringIO()
    g = sc.sticky.setdefault(SHARED_GLOBALS_KEY, {"__name__": "__lamcp_bridge__"})
    error_text = None
    result_repr = None
    try:
        with contextlib.redirect_stdout(out), contextlib.redirect_stderr(err):
            exec(code, g, g)
            result_repr = repr(g.get("_"))
    except BaseException:
        error_text = traceback.format_exc()

    return {
        "stdout": out.getvalue(),
        "stderr": err.getvalue(),
        "result": result_repr,
        "error": error_text,
    }


class _ExecHandler(BaseHTTPRequestHandler):
    # Silence default request logging so it doesn't clog the Rhino command line.
    def log_message(self, fmt, *args):
        pass

    def _send(self, code, payload):
        body = json.dumps(payload).encode("utf-8")
        self.send_response(code)
        self.send_header("Content-Type", "application/json")
        self.send_header("Content-Length", str(len(body)))
        self.end_headers()
        self.wfile.write(body)

    def do_GET(self):
        if self.path == "/health":
            self._send(200, {"status": "ok"})
        else:
            self._send(404, {"error": "not found"})

    def do_POST(self):
        if self.path != "/exec":
            self._send(404, {"error": "not found"})
            return
        length = int(self.headers.get("Content-Length", "0"))
        try:
            raw = self.rfile.read(length).decode("utf-8")
            body = json.loads(raw)
            code = body.get("code", "")
            timeout = float(body.get("timeout", 30.0))
        except Exception as exc:
            self._send(400, {"error": "bad request: " + repr(exc)})
            return
        result = _exec_code(code, timeout)
        self._send(200, result)


def _start_server(port):
    server = HTTPServer(("127.0.0.1", port), _ExecHandler)
    thread = threading.Thread(
        target=server.serve_forever, daemon=True, name="lamcp-bridge"
    )
    thread.start()
    return {"server": server, "thread": thread, "port": port}


def _stop_server(state):
    try:
        state["server"].shutdown()
        state["server"].server_close()
    except Exception:
        pass


class LamcpBridgeComponent(Grasshopper.Kernel.GH_ScriptInstance):
    def RunScript(self, enable: bool, port: int):
        port = int(port) if port else 8765

        state = sc.sticky.get(SERVER_KEY)

        if not enable:
            if state is not None:
                _stop_server(state)
                del sc.sticky[SERVER_KEY]
            return "stopped"

        # Already running on the requested port: no-op.
        if (
            state is not None
            and state.get("port") == port
            and state["thread"].is_alive()
        ):
            return "listening on http://127.0.0.1:{}".format(port)

        # Port changed or server died: tear down and restart.
        if state is not None:
            _stop_server(state)
            del sc.sticky[SERVER_KEY]

        try:
            sc.sticky[SERVER_KEY] = _start_server(port)
        except OSError as exc:
            ghenv.Component.AddRuntimeMessage(  # noqa: F821
                Grasshopper.Kernel.GH_RuntimeMessageLevel.Error,
                "Failed to bind 127.0.0.1:{}: {}".format(port, exc),
            )
            return "error: {}".format(exc)

        return "listening on http://127.0.0.1:{}".format(port)
# ---------- end lamcp_bridge ----------
panel = Panel(lamcp_bridge)

# ---- group: DESIGN
# design: "slice" a cylinder
slice_cylinder = SliceCylinder(
    radius=radius_mm,
    height=height_mm,
    layer_height=layer_height_mm,
    point_spacing=point_spacing_mm,
    center_x=center_x_mm,
    center_y=center_y_mm,
    fine_adjust_z=fine_adjust_z_mm)  # -> layers
# ---------- slice_cylinder: Python ----------
# r: compas
# venv: mas-2627
"""
Slice a cylinder into layers, in work object coordinates (Rhino world XY = work object).
One closed compas Polyline per layer. Units: mm.
center_x, center_y: where the cylinder stands on the work object.
fine_adjust_z: shifts all layers up/down, to tune the nozzle height above the bed (0 = first layer at z = 0).
"""
import math

from compas.geometry import Point
from compas.geometry import Polyline

# ===== How many layers, how many points per layer =====
layer_count = int(height / layer_height)
points_per_layer = round(2 * math.pi * radius / point_spacing)

# ===== One closed polyline per layer =====
layers = []
for i in range(layer_count):
    z = i * layer_height + fine_adjust_z
    points = []
    for j in range(points_per_layer + 1):  # one extra point: back to the start to close the ring
        angle = 2 * math.pi * (j % points_per_layer) / points_per_layer
        points.append(Point(center_x + radius * math.cos(angle), center_y + radius * math.sin(angle), z))
    layers.append(Polyline(points))
# ---------- end slice_cylinder ----------

# ---- group: ② 新電池 (Python，取代 TACO)
# LONG-0
data_13 = Data(Tree({0}: [Point(1064.968023, 69.61536877, -22.0951418), Point(1060.495361, 78.54753958, -22.0951418), Point(1056.406994, 87.66219445, -22.0951418), Point(1052.673556, 96.92799022, -22.0951418), Point(1049.277483, 106.3227529, -22.0951418), Point(1046.200776, 115.826976, -22.0951418)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], {1}: [Point(1000.048941, 967.2913899, -19.6), Point(1006.72697, 961.6741647, -19.6), Point(1013.404999, 956.0569396, -19.6), Point(1021.834842, 956.8478651, -19.6), Point(1030.264684, 957.6387906, -19.6), Point(1038.694527, 958.4297162, -19.6)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], {2}: [Point(1008.363232, 821.5514862, -19.6), Point(1015.314991, 816.3311464, -19.6), Point(1022.266749, 811.1108067, -19.6), Point(1030.682302, 812.7739567, -19.6), Point(1039.097855, 814.4371068, -19.6), Point(1047.513408, 816.1002568, -19.6)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], {3}: [Point(1017.697416, 675.8015717, -19.6), Point(1025.115927, 671.0735097, -19.6), Point(1032.534438, 666.3454477, -19.6), Point(1041.093693, 668.8661543, -19.6), Point(1049.652949, 671.3868608, -19.6), Point(1058.212204, 673.9075674, -19.6)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], {4}: [Point(1027.273132, 529.8887789, -19.6), Point(1035.274657, 525.7660413, -19.6), Point(1043.276183, 521.6433036, -19.6), Point(1052.310251, 525.0551804, -19.6), Point(1061.344319, 528.4670571, -19.6), Point(1070.378387, 531.8789339, -19.6)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], {5}: [Point(1036.256513, 383.8144017, -19.6), Point(1045.069163, 380.4312345, -19.6), Point(1053.881813, 377.0480672, -19.6), Point(1061.269974, 380.308958, -19.6), Point(1068.658135, 383.5698487, -19.6), Point(1076.046296, 386.8307395, -19.6)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]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))

# test 3
data_14 = Data(Tree({0}: [Point(1024.07389, 301.1756035, -22.0951418), Point(1032.815384, 303.061238, -22.0951418), Point(1041.556877, 304.9468724, -22.0951418), Point(1050.298371, 306.8325068, -22.0951418), Point(1059.039865, 308.7181412, -22.0951418), Point(1067.781359, 310.6037757, -22.0951418)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], {1}: [Point(1004.880058, 680.4668244, -17.15), Point(1005.421219, 672.564773, -17.15), Point(1005.962379, 664.6627216, -17.15), Point(1006.052061, 663.4203733, -17.15), Point(1006.459799, 657.7720464, -17.15), Point(1013.566287, 659.8412513, -17.15)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], {2}: [Point(1014.0881, 533.8447621, -17.15), Point(1014.617446, 525.5468204, -17.15), Point(1015.146793, 517.2488787, -17.15), Point(1015.161346, 517.0116765, -17.15), Point(1015.572855, 510.304592, -17.15), Point(1023.18775, 513.1447919, -17.15)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], {3}: [Point(1022.186681, 387.3341627, -17.15), Point(1022.646024, 378.7825623, -17.15), Point(1023.105366, 370.2309618, -17.15), Point(1023.134076, 369.6964779, -17.15), Point(1023.447343, 362.7650587, -17.15), Point(1031.799748, 366.3952496, -17.15)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]))

# test 2
data_15 = Data(Tree({0}: [Point(1024.07389, 301.1756035, -22.5951418), Point(1032.815384, 303.061238, -22.5951418), Point(1041.556877, 304.9468724, -22.5951418), Point(1050.298371, 306.8325068, -22.5951418), Point(1059.039865, 308.7181412, -22.5951418), Point(1067.781359, 310.6037757, -22.5951418)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], {1}: [Point(1005.433839, 680.2826305, -17.15), Point(1005.987211, 672.2206795, -17.15), Point(1006.540582, 664.1587285, -17.15), Point(1006.626698, 662.9657665, -17.15), Point(1007.049301, 657.1114652, -17.15), Point(1014.007407, 659.2053215, -17.15)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], {2}: [Point(1014.679149, 533.587763, -17.15), Point(1015.221919, 525.1367642, -17.15), Point(1015.76469, 516.6857654, -17.15), Point(1015.774822, 516.5220502, -17.15), Point(1016.204222, 509.5839288, -17.15), Point(1023.658066, 512.4639194, -17.15)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], {3}: [Point(1022.8319, 387.0299414, -17.15), Point(1023.30415, 378.3585165, -17.15), Point(1023.7764, 369.6870916, -17.15), Point(1023.810101, 369.0682738, -17.15), Point(1024.138273, 361.9798626, -17.15), Point(1032.312689, 365.6662676, -17.15)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]))

# test
data_16 = Data(Tree({0}: [Point(1024.07389, 301.1756035, -22.5951418), Point(1032.815384, 303.061238, -22.5951418), Point(1041.556877, 304.9468724, -22.5951418), Point(1050.298371, 306.8325068, -22.5951418), Point(1059.039865, 308.7181412, -22.5951418), Point(1067.781359, 310.6037757, -22.5951418)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], {1}: [Point(1020.84521, 714.277795, -17.15), Point(1012.795176, 711.9985339, -17.15), Point(1004.745141, 709.7192728, -17.15), Point(1005.379202, 700.5161657, -17.15), Point(1006.013263, 691.3130586, -17.15), Point(1006.647324, 682.1099515, -17.15)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], {2}: [Point(1016.118485, 533.3130938, -17.15), Point(1016.675049, 524.7424216, -17.15), Point(1017.23204, 516.1649455, -17.15), Point(1017.687287, 508.9125695, -17.15), Point(1024.744264, 511.8148649, -17.15), Point(1033.69015, 515.5414393, -17.15)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], {3}: [Point(1024.404995, 386.7056417, -17.15), Point(1024.890677, 377.9839369, -17.15), Point(1025.376358, 369.2622321, -17.15), Point(1025.41946, 368.4882226, -17.15), Point(1025.768039, 361.2431799, -17.15), Point(1033.504892, 364.9672551, -17.15)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]))

# ----
compas_draw = COMPASDraw(cg=slice_cylinder)  # -> rg
#   port cg: The COMPAS geometry or datastructure to be drawn.
#   port rg: The Rhino geometry object.
# ---------- compas_draw: Python ----------
# r: compas>=2.14.1
"""
Draws COMPAS geometry in Grasshopper.
"""

from typing import Any

import Grasshopper

from compas.scene import SceneObject


class CompasToRhinoGeometry(Grasshopper.Kernel.GH_ScriptInstance):
    def RunScript(self, cg):
        if not cg:
            return None

        return SceneObject(item=cg).draw()
# ---------- end compas_draw ----------
evalsrf = EvaluateSurface(Surface=reparameterize(printbed_position), Point=pt)  # -> Point, Normal, UDirection, VDirection, Frame

# ---- group: ② 新電池 (Python，取代 TACO)
# LONG-0
data_17 = Data(Tree({0}: [Point(1064.968023, 69.61536877, -22.0951418), Point(1060.495361, 78.54753958, -22.0951418), Point(1056.406994, 87.66219445, -22.0951418), Point(1052.673556, 96.92799022, -22.0951418), Point(1049.277483, 106.3227529, -22.0951418), Point(1046.200776, 115.826976, -22.0951418)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], {1}: [Point(986.7737388, 973.5282024, -17.15), Point(987.2175103, 966.5098464, -17.15), Point(987.6612818, 959.4914903, -17.15), Point(987.9667147, 955.4815457, -17.15), Point(988.1719646, 952.7868748, -17.15), Point(994.8720503, 953.3730342, -17.15)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], {2}: [Point(995.5294879, 827.0241763, -17.15), Point(996.0316733, 819.5109379, -17.15), Point(996.5338587, 811.9976995, -17.15), Point(996.7225869, 809.528357, -17.15), Point(997.0513303, 805.2270382, -17.15), Point(1003.828128, 806.5380067, -17.15)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], {3}: [Point(1004.880058, 680.4668244, -17.15), Point(1005.421219, 672.564773, -17.15), Point(1005.962379, 664.6627216, -17.15), Point(1006.052061, 663.4203733, -17.15), Point(1006.459799, 657.7720464, -17.15), Point(1013.566287, 659.8412513, -17.15)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], {4}: [Point(1014.0881, 533.8447621, -17.15), Point(1014.617446, 525.5468204, -17.15), Point(1015.146793, 517.2488787, -17.15), Point(1015.161346, 517.0116765, -17.15), Point(1015.572855, 510.304592, -17.15), Point(1023.18775, 513.1447919, -17.15)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], {5}: [Point(1022.186681, 387.3341627, -17.15), Point(1022.646024, 378.7825623, -17.15), Point(1023.105366, 370.2309618, -17.15), Point(1023.134076, 369.6964779, -17.15), Point(1023.447343, 362.7650587, -17.15), Point(1031.799748, 366.3952496, -17.15)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]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))

# LONG-2
data_18 = Data(Tree({0}: [Point(1525.058685, 381.0297419, -22.0951418), Point(1530.122925, 372.5492878, -22.0951418), Point(1535.290958, 364.1316983, -22.0951418), Point(1540.572333, 355.7847712, -22.0951418), Point(1545.976507, 347.516839, -22.0951418), Point(1551.512696, 339.3367378, -22.0951418)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], {1}: [Point(1296.251449, 1003.940527, -17.15), Point(1294.210367, 1011.838396, -17.15), Point(1292.962795, 1016.665816, -17.15), Point(1284.161923, 1016.019412, -17.15), Point(1275.36105, 1015.373008, -17.15), Point(1266.560178, 1014.726604, -17.15)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], {2}: [Point(1329.125231, 880.7157732, -17.15), Point(1326.966995, 888.0759533, -17.15), Point(1324.821032, 895.3942788, -17.15), Point(1316.866363, 893.8859979, -17.15), Point(1308.911694, 892.3777171, -17.15), Point(1300.957025, 890.8694362, -17.15)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], {3}: [Point(1328.187269, 736.6511855, -17.15), Point(1330.363629, 730.9424718, -17.15), Point(1332.998185, 724.0318828, -17.15), Point(1335.030642, 719.0309337, -17.15), Point(1339.816537, 720.8141412, -17.15), Point(1349.101926, 724.4238466, -17.15)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], {4}: [Point(1376.752208, 615.8331521, -17.15), Point(1378.910694, 610.9292791, -17.15), Point(1380.927799, 606.3466097, -17.15), Point(1382.944904, 601.7639403, -17.15), Point(1385.262192, 596.7037248, -17.15), Point(1390.047317, 599.3362337, -17.15)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], {5}: [Point(1433.48345, 492.8325957, -17.15), Point(1436.130186, 487.5197632, -17.15), Point(1438.776922, 482.2069306, -17.15), Point(1441.374392, 477.0645836, -17.15), Point(1446.500192, 480.7767282, -17.15), Point(1453.540525, 485.9724377, -17.15)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]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))

# LONG-3
data_19 = Data(Tree({0}: [Point(1798.951465, 387.9570392, -22.0951418), Point(1803.759189, 384.5322054, -22.0951418), Point(1808.740787, 381.1251335, -22.0951418), Point(1813.767008, 377.7842346, -22.0951418), Point(1808.862273, 381.1217219, -22.0951418), Point(1803.977604, 384.4885078, -22.0951418)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], {1}: [Point(1352.699377, 1050.962961, -17.15), Point(1354.729385, 1045.543699, -17.15), Point(1357.418838, 1038.363998, -17.15), Point(1365.522166, 1038.859799, -17.15), Point(1373.625494, 1039.355599, -17.15), Point(1381.728823, 1039.8514, -17.15)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], {2}: [Point(1434.483309, 953.4343536, -17.15), Point(1432.526673, 959.0792715, -17.15), Point(1429.935391, 966.5551517, -17.15), Point(1420.705102, 965.3937352, -17.15), Point(1411.474813, 964.2323187, -17.15), Point(1402.244524, 963.0709022, -17.15)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], {3}: [Point(1476.295692, 841.7445744, -17.15), Point(1474.325244, 846.3401796, -17.15), Point(1472.113757, 851.4979504, -17.15), Point(1469.902271, 856.6557211, -17.15), Point(1461.9903, 854.5384587, -17.15), Point(1454.078329, 852.4211963, -17.15)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], {4}: [Point(1498.998064, 712.3620363, -17.15), Point(1502.927951, 705.432818, -17.15), Point(1506.857839, 698.5035998, -17.15), Point(1510.543404, 700.3545577, -17.15), Point(1517.58172, 704.1044417, -17.15), Point(1524.620036, 707.8543257, -17.15)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], {5}: [Point(1562.578909, 608.7769111, -17.15), Point(1566.32522, 603.3581833, -17.15), Point(1570.071531, 597.9394555, -17.15), Point(1573.075488, 593.8289487, -17.15), Point(1576.676951, 596.5346906, -17.15), Point(1583.206369, 601.6387074, -17.15)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]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))

# LONG-1
data_20 = Data(Tree({0}: [Point(1346.635911, 203.4134388, -22.0951418), Point(1351.413501, 194.9031848, -22.0951418), Point(1356.473718, 186.5579859, -22.0951418), Point(1361.837475, 178.4046915, -22.0951418), Point(1367.526916, 170.475388, -22.0951418), Point(1373.563674, 162.8073735, -22.0951418)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], {1}: [Point(1107.765638, 1043.790602, -17.15), Point(1109.436883, 1034.309581, -17.15), Point(1110.198054, 1029.991437, -17.15), Point(1119.190449, 1030.451809, -17.15), Point(1128.182845, 1030.912181, -17.15), Point(1137.17524, 1031.372553, -17.15)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], {2}: [Point(1131.192955, 907.3585386, -17.15), Point(1132.988592, 897.7232721, -17.15), Point(1133.009444, 897.6113834, -17.15), Point(1134.200421, 891.7926063, -17.15), Point(1140.267688, 892.6944265, -17.15), Point(1149.232789, 894.1229542, -17.15)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], {3}: [Point(1156.971942, 771.514033, -17.15), Point(1158.882676, 762.3496107, -17.15), Point(1159.404171, 759.8483726, -17.15), Point(1160.719824, 753.9343549, -17.15), Point(1166.697226, 755.578116, -17.15), Point(1175.276211, 757.987671, -17.15)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], {4}: [Point(1185.975389, 636.1345902, -17.15), Point(1187.973766, 627.5184491, -17.15), Point(1189.042847, 622.9090346, -17.15), Point(1190.491201, 616.860613, -17.15), Point(1196.652954, 619.3423157, -17.15), Point(1205.117518, 622.7856749, -17.15)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], {5}: [Point(1217.648507, 501.1241033, -17.15), Point(1219.692042, 492.94468, -17.15), Point(1221.30088, 486.505168, -17.15), Point(1222.83383, 480.378081, -17.15), Point(1229.399436, 483.7803605, -17.15), Point(1238.136911, 488.3603974, -17.15)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]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))

# ---- group: PRINTPATH
# generate printpath: printpoints and path
safety_distance_mm = Slider(100, range=10..300)
blend_radius_mm = Slider(0.5, range=0..5)
speed_mm_s = Slider(10, range=1..50)
printpath = Printpath(layers=slice_cylinder, speed=speed_mm_s, blend_radius=blend_radius_mm, safety_distance=safety_distance_mm)  # -> printpath, summary; inputs layers: list
# ---------- printpath: Python ----------
# r: compas
# venv: mas-2627
"""
Turn the layers into printpoints and a PrintPath, in work object coordinates.
Safety points are added here, before any transform to the robot base.
"""
import os
import sys

from compas.geometry import Frame, Vector


# Find source folder
gh_dir = os.path.dirname(ghenv.Component.OnPingDocument().FilePath)
src_dir = os.path.join(gh_dir, "..", "..", "src")
if src_dir not in sys.path:
    sys.path.append(src_dir)
from print_class import PrintPoint, PrintPath

# ===== One printpoint per point =====
# world XY orientation for every point: a tangent frame would turn the wrist 360 degrees each layer
printpoints = []
for layer_index, layer in enumerate(layers):
    for point in layer.points:
        frame = Frame(point, -Vector.Xaxis(), Vector.Yaxis())
        printpoints.append(PrintPoint(frame, layer_index, speed, blend_radius, True))

# ===== Path with a travel point above the start and the end =====
printpath = PrintPath(printpoints)
printpath.add_safety_before(safety_distance, speed)
printpath.add_safety_after(safety_distance, speed)

summary = f"{len(printpoints)} printpoints in {len(layers)} layers, plus 2 safety points"
# ---------- end printpath ----------
panel_2 = Panel(printpath.summary)

# ----
curve = Curve(compas_draw)
prot = RotatePlane(Plane=evalsrf.Frame, Angle=degrees(number_slider_2))
deplane = DeconstructPlane(Plane=prot)  # -> Origin, XAxis, YAxis, ZAxis
Z = UnitZ(Factor=1)
data_21 = Data(printpath.printpath)
dprod = DotProduct(VectorA=Z, VectorB=deplane.ZAxis, Unitize=False)
panel_3 = Panel(data_21)
expression = Expression(x=dprod, Expression="if(x<0,True,False)")
pflip = FlipPlane(Plane=prot, ReverseX=False, ReverseY=False, SwapAxes=True)

split = SplitList(List=data_12, Index=Slider(250, range=0..1000))  # -> ListA, ListB

filter = StreamFilter(Gate=expression, Stream0=prot, Stream1=pflip)
first_layer_lift = Panel("2")
deplane_2 = DeconstructPlane(Plane=filter)  # -> Origin, XAxis, YAxis, ZAxis
addition = Addition(A=first_layer_lift, B="0")
amp = Amplitude(Vector=deplane_2.ZAxis, Amplitude=addition)
move = Move(Geometry=filter, Motion=amp)  # -> Geometry, Transform
place_on_bed = Python3Script(printpath=data_21, bed_plane=move.Geometry)  # -> printpath_on_bed, summary; inputs bed_plane: Plane
# ---------- place_on_bed: Python ----------
# r: compas
# venv: mas-2627
"""
Place the printpath on the print bed.
bed_plane comes from 校正桌面: the bed surface at (u, v), turned by the object angle, z up, raised by the first layer offset.
The printpath is built around world XY, so world XY is moved onto bed_plane.
The output is a normal PrintPath (now in robot base coordinates), so preview and save work as before.
"""
import os
import sys

from compas.geometry import Frame, Transformation
from compas_rhino.conversions import plane_to_compas_frame

# Find source folder
gh_dir = os.path.dirname(ghenv.Component.OnPingDocument().FilePath)
src_dir = os.path.join(gh_dir, "..", "..", "src")
if src_dir not in sys.path:
    sys.path.append(src_dir)
from print_class import PrintPath

# ===== world XY -> bed plane =====
bed = plane_to_compas_frame(bed_plane)
transformation = Transformation.from_frame_to_frame(Frame.worldXY(), bed)

# ===== New printpath, the original stays untouched =====
placed = []
for printpoint in printpath.printpoints:
    new_printpoint = printpoint.copy()
    new_printpoint.frame.transform(transformation)
    placed.append(new_printpoint)
printpath_on_bed = PrintPath(placed)

z_values = [printpoint.frame.point.z for printpoint in placed]
summary = f"bed origin: {[round(v, 2) for v in bed.point]}\nz from {min(z_values):.1f} to {max(z_values):.1f} mm (robot base)"
# ---------- end place_on_bed ----------

pln = Plane(data_12)
xy = XYPlane(Origin=pln)

panel_4 = Panel(place_on_bed.summary)

pline = PolyLine(Vertices=data_12, Closed=False)
bbox = BoundingBox(Content=pline, Plane=PlaneXY(0, 0, 0), UnionBox=False)  # -> Box, Box_2
debrep = DeconstructBrep(Brep=bbox.Box)  # -> Faces, Edges, Vertices
item = ListItem(List=debrep.Faces, Index="4", Wrap="4")
area = Area(Geometry=item)  # -> Area, Centroid
xy_2 = XYPlane(Origin=area.Centroid)
rotate = Rotate(Geometry=xy_2, Angle=degrees(Slider(0, range=0..180)), Plane=xy_2)  # -> Geometry, Transform
pln_2 = Plane(rotate.Geometry)
item_2 = ListItem(List=flatten(pln_2), Index=0, Wrap=True)

# ---- group: EXPORT
# export: preview and save
# PrintPath= PrintPoint Combination
# (
# 1_compas frame,
# 2_layer_index,
# 3_speed(mm/s),
# 4_blend_radius(mm),
# 5_extruder_IO
# )
panel_5 = Panel("data/out_printpoints_weijiun.json")
save = Button()
preview = Preview(printpath=place_on_bed.printpath_on_bed)  # -> path, travel, planes
# ---------- preview: Python ----------
# r: compas
# venv: mas-2627
"""
Draw the printpath: path = the whole polyline, travel = extruder-off segments,
safety = extruder-off points, axes = small x and y axis of each frame.
"""
import Rhino.Geometry as rg
from compas_rhino.conversions import frame_to_rhino_plane, point_to_rhino

AXIS_LENGTH = 5.0  # mm

points = printpath.printpoints
planes = [frame_to_rhino_plane(printpoint.frame) for printpoint in points]

# ===== Whole path =====
polyline = rg.Polyline()
for plane in planes:
    polyline.Add(plane.Origin.X, plane.Origin.Y, plane.Origin.Z)
path = polyline.ToPolylineCurve()

# ===== Extruder off: a segment prints only if both of its points have the extruder on =====
safety = [point_to_rhino(printpoint.frame.point) for printpoint in points if not printpoint.is_extruder_on]
travel = []
for i in range(len(points) - 1):
    if not (points[i].is_extruder_on and points[i + 1].is_extruder_on):
        travel.append(rg.Line(planes[i].Origin, planes[i + 1].Origin))
# ---------- end preview ----------
save_2 = Save(printpath=place_on_bed.printpath_on_bed, save=save, out_path=panel_5)  # -> status
# ---------- save_2: Python ----------
# r: compas
# venv: mas-2627
"""
On button press, write the printpath to data/out_printpoints.json next to this .ghx file.
send_to_robot.py reads that file.
"""
import json
import os

import scriptcontext as sc

gh_dir = os.path.dirname(ghenv.Component.OnPingDocument().FilePath)

# keep the last status in sticky, so the message survives the button being released
status_key = "save_status_" + str(ghenv.Component.InstanceGuid)

if save:
    if printpath is None:
        sc.sticky[status_key] = "nothing to save: no printpath"
    else:
        path = os.path.normpath(os.path.join(gh_dir, out_path))
        os.makedirs(os.path.dirname(path), exist_ok=True)
        with open(path, "w") as f:
            json.dump(printpath.to_dict(), f, indent=2)
        sc.sticky[status_key] = f"saved {len(printpath)} printpoints to {path}"

status = sc.sticky.get(status_key, "")
ghenv.Component.Message = "saved" if status.startswith("saved") else status
# ---------- end save_2 ----------
plane = Plane(preview.planes)
curve_2 = Curve(preview.travel)
curve_3 = Curve(preview.path)
panel_6 = Panel(save_2)
preview_2 = CustomPreview(Geometry=curve_3, Material=ColourSwatch(SwatchColor=RGB(0, 170, 80)))
preview_3 = CustomPreview(Geometry=curve_2, Material=ColourSwatch(SwatchColor=RGB(230, 40, 40)))

# ----
pick_safe_preview = Python3Script()  # -> planes; inputs frames: list
# ---------- pick_safe_preview: Python ----------
"""
Convert COMPAS Frames to Rhino Planes for preview.
    Input:  frames (List Access, No Type Hint)
    Output: planes
"""
import Rhino.Geometry as rg
from compas.geometry import Frame
from compas_rhino.conversions import frame_to_rhino_plane


def to_plane(item):
    if item is None:
        return None
    if isinstance(item, rg.Plane):
        return item
    if isinstance(item, Frame):
        return frame_to_rhino_plane(item)
    raise TypeError("Not a COMPAS Frame: {}".format(type(item)))


def flatten(items):
    for item in items:
        if isinstance(item, (list, tuple)):
            for sub in flatten(item):
                yield sub
        else:
            yield item


planes = [to_plane(f) for f in flatten(frames or [])]
ghenv.Component.Message = "{} planes".format(len(planes))
# ---------- end pick_safe_preview ----------

# ----
# FINAL INTERLOCK TEST1
data_22 = Data([Point(1491.405012, 3447.758038, -6), Point(1499.820066, 3452.733061, -6), Point(1508.235119, 3457.708084, -6), Point(1516.650172, 3462.683106, -6), Point(1525.065225, 3467.658129, -6), Point(1533.480278, 3472.633152, -6)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])  # disabled

# ---- group: IRB_2600_20165
irb2600_home_meshes = Mesh([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])  # disabled

# ----
# 透過10mm等分的數量 等分線段
mesh = Mesh(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)  # disabled
unit_z = UnitZ(Factor=1)  # disabled
panel_7 = Panel("2")  # disabled
panel_8 = Panel("2")  # disabled
contour = Contour(Shape=mesh, Point=Point(0, 0, 0), Direction=unit_z, Distance=panel_7)  # -> flatten(Contours); disabled
division = Division(A=number_slider_3, B=panel_8)  # disabled
panel_9 = Panel(division)  # disabled
join_curves = JoinCurves(Curves=contour, Preserve=False)  # disabled
negative = Negative(Value=panel_9)  # disabled
offset_curve = OffsetCurve(Curve=graft(join_curves), Distance=negative, Corners=1)  # -> simplify(flatten(Curve)); disabled
boundary_surfaces = BoundarySurfaces(Edges=offset_curve)  # disabled

list_item = ListItem(List=offset_curve, Index=0, Wrap=True)  # disabled
align_curves = AlignCurves(Curves=offset_curve, Guide=list_item)  # disabled

number_slider_5 = Slider(0.1, range=0..0.1)  # disabled
evaluate_length = EvaluateLength(Curve=align_curves, Length=number_slider_5, Normalized=True)  # -> Point, Tangent, Parameter; disabled
vector_display = VectorDisplay(Anchor=evaluate_length.Point, Vector=evaluate_length.Tangent)  # disabled

point = Point(Point(1495.92091, 3420.910825, -1.37087664))  # disabled
align_curve_seams = AlignCurveSeams(Curves=flatten(align_curves), Guide=point, Snap=False, Iterative=True)  # -> Aligned, Points, ResultBoolean; disabled
point_2 = Point(align_curve_seams.Points)  # disabled

explode = Explode(Curve=align_curve_seams.Aligned, Recursive=True)  # -> flatten(Segments), Vertices; disabled
panel_10 = Panel("10")  # disabled
divide_length = DivideLength(Curve=graft(explode.Segments), Length=panel_10)  # -> Points, Tangents, Parameters; disabled
list_length = ListLength(List=divide_length.Points)  # disabled
divide_curve = DivideCurve(Curve=graft(explode.Segments), Count=list_length, Kinks=False)  # -> flatten(Points), Tangents, Parameters; disabled
cull_duplicates = CullDuplicates(Points=divide_curve.Points, Tolerance=0.1, CullMode=3)  # -> Points, Indices, Valence; disabled

flip_curve = FlipCurve(Curve=align_curve_seams.Aligned)  # -> Curve, Flag; disabled

number_slider_6 = Slider(1, range=0..10)  # disabled
point_list = PointList(Points=cull_duplicates.Points, Size=number_slider_6)  # disabled
polyline = PolyLine(Vertices=cull_duplicates.Points, Closed=False)  # disabled

# ---- group: ② 新電池 (Python，取代 TACO)
panel_11 = Panel("1556.32,-951.12,-368.97")
panel_12 = Panel("1517.62,989.35,-360.76")
panel_13 = Panel("575.35,990.12,-365.06")
panel_14 = Panel("595.68,-963.48,-379.78")
沒有磁磚的高度 = Panel("200")
pln_3 = Plane(Plane(origin=(1143.177612, 56.72019577, -121.1006546), x=(0.9999674455, 0.007892070842, -0.001680227304), y=(0.007985649777, -0.9977942938, 0.06589974777)))  # disabled
panel_15 = Panel("0")  # disabled
number_slider_7 = Slider(50, range=0..100)  # disabled
number_slider_8 = Slider(100, range=0..100)  # disabled
panel_16 = Panel("WaitTime 1;")  # disabled
panel_17 = Panel("SetDO Local_IO_0_DO2,0;")  # disabled
panel_18 = Panel("WaitTime 4;")  # disabled
panel_19 = Panel("WaitTime 1;")  # disabled
panel_20 = Panel("SetDO Local_IO_0_DO2,1;")  # disabled
panel_21 = Panel("fine")  # disabled
panel_22 = Panel("100")  # disabled
Z_2 = UnitZ(Factor=number_slider_7)  # disabled
Z_3 = UnitZ(Factor=number_slider_8)  # disabled
entwine = Entwine(Branch00=panel_16, Branch01=panel_17, FlattenInputs=True)  # -> flatten(Result); disabled
entwine_2 = Entwine(Branch00=panel_19, Branch01=panel_20, Branch02=panel_18, FlattenInputs=True)  # -> flatten(Result); disabled
panel_23 = Panel("WaitTime 1;")  # disabled
panel_24 = Panel("WaitTime 3;")  # disabled
run = Button()  # disabled
stop = Button()  # disabled

# ----
# 校正桌面
srf4pt = _4PointSurface(CornerA=panel_11, CornerB=panel_12, CornerC=panel_13, CornerD=panel_14)

# ---- group: ② 新電池 (Python，取代 TACO) / 加熱桌高度
沒有磁磚的高度_2 = Panel("-14.5")
Z_4 = UnitZ(Factor=沒有磁磚的高度)
move_2 = Move(Geometry=srf4pt, Motion=Z_4)  # -> Geometry, Transform

# ----
evalsrf_2 = EvaluateSurface(Surface=reparameterize(srf4pt), Point=pt_2)  # -> Point, Normal, UDirection, VDirection, Frame
prot_2 = RotatePlane(Plane=evalsrf_2.Frame, Angle=degrees(number_slider_4))
第一層提高 = Panel("2")
addition_2 = Addition(A=第一層提高, B="2")

# ---- group: check Z axis
deplane_3 = DeconstructPlane(Plane=prot_2)  # -> Origin, XAxis, YAxis, ZAxis
Z_5 = UnitZ(Factor=1)
dprod_2 = DotProduct(VectorA=Z_5, VectorB=deplane_3.ZAxis, Unitize=False)
expression_2 = Expression(x=dprod_2, Expression="if(x<0,True,False)")
pflip_2 = FlipPlane(Plane=prot_2, ReverseX=False, ReverseY=False, SwapAxes=True)

# ----
filter_2 = StreamFilter(Gate=expression_2, Stream0=prot_2, Stream1=pflip_2)
deplane_4 = DeconstructPlane(Plane=filter_2)  # -> Origin, XAxis, YAxis, ZAxis
amp_2 = Amplitude(Vector=deplane_4.ZAxis, Amplitude=addition_2)
move_3 = Move(Geometry=filter_2, Motion=amp_2)  # -> Geometry, Transform

# ---- group: ② 新電池 (Python，取代 TACO) (continued)
orient = Orient(Geometry=xy, Source=item_2, Target=move_3.Geometry)  # -> Geometry, Transform
polyline_2 = PolyLine(Vertices=orient.Geometry, Closed=False)  # disabled
pl_origin = PlaneOrigin(Base=pln_3, Origin=orient.Geometry)  # disabled
rotate_2 = Rotate(Geometry=pl_origin, Angle=panel_15, Plane=pl_origin)  # -> Geometry, Transform; disabled
list_item_2 = ListItem(List=rotate_2.Geometry, Index=0, Wrap=True)  # -> Item1, Item; disabled
move_4 = Move(Geometry=list_item_2.Item1, Motion=Z_2)  # -> Geometry, Transform; disabled
move_5 = Move(Geometry=list_item_2.Item, Motion=Z_3)  # -> Geometry, Transform; disabled

# ---- group: ② 新電池 (Python，取代 TACO) / Construct TCP
tcp_builder = TCPBuilder(Plane=move_5.Geometry, Speed=panel_22, Zone=panel_21, Command=panel_24, E1="0")  # -> TCP; inputs Plane: list of Plane, Speed: list, Zone: list, Command: list, E1: list; disabled
# ---------- tcp_builder: Python ----------
#! python3
"""TCP Builder - replaces TACO Construct TCP.
Inputs are matched longest-list style (a shorter list repeats its last item),
like TACO / Grasshopper item matching: 1 plane + 3 commands = 3 targets.

Inputs
    Plane   : list of TCP planes in robot base coordinates
    Speed   : mm/s (100 -> v100) or speeddata name (v200 stays v200)
    Zone    : fine, 10 (-> z10) or zonedata name (z5 stays z5)
    Command : extra RAPID line written after the move (empty / NULL = none)
    E1      : external axis value

Output
    TCP     : list of TCP targets for Path Solver (merge several builders in order)
"""
import Grasshopper
import Rhino


class TcpTarget(object):
    """Plane + move settings. Path Solver reads these attributes."""
    __slots__ = ("plane", "speed", "zone", "cmd", "e1")

    def __init__(self, plane, speed, zone, cmd, e1):
        self.plane, self.speed, self.zone, self.cmd, self.e1 = plane, speed, zone, cmd, e1

    def __repr__(self):
        return "TCP {} {}{}".format(self.speed, self.zone, " +cmd" if self.cmd else "")


def _pick(lst, i, default):
    if not lst:
        return default
    v = lst[min(i, len(lst) - 1)]
    return default if v is None else v


class Script_Instance(Grasshopper.Kernel.GH_ScriptInstance):
    def RunScript(self,
            Plane: list[Rhino.Geometry.Plane],
            Speed: list[object],
            Zone: list[object],
            Command: list[object],
            E1: list[object]):
        planes = [p for p in (Plane or []) if p is not None]
        if not planes:
            return []
        # longest list: one plane with three commands gives three targets on that plane
        n = max([len(planes)] + [len(x) for x in (Speed, Zone, Command, E1) if x])
        out = []
        for i in range(n):
            pl = _pick(planes, i, None)
            cmd = str(_pick(Command, i, "")).strip()
            out.append(TcpTarget(pl,
                                 str(_pick(Speed, i, "100")).strip(),
                                 str(_pick(Zone, i, "fine")).strip(),
                                 "" if cmd.upper() in ("", "NULL", "NONE") else cmd,
                                 float(_pick(E1, i, 0) or 0)))
        return out
# ---------- end tcp_builder ----------

tcp_builder_2 = TCPBuilder(Plane=list_item_2.Item, Speed=panel_22, Zone=panel_21, Command=entwine_2, E1="0")  # -> TCP; inputs Plane: list of Plane, Speed: list, Zone: list, Command: list, E1: list; disabled; same code as tcp_builder

tcp_builder_3 = TCPBuilder(Plane=rotate_2.Geometry, Speed=panel_22, Zone="10", Command="NULL ", E1="0")  # -> TCP; inputs Plane: list of Plane, Speed: list, Zone: list, Command: list, E1: list; disabled; same code as tcp_builder

tcp_builder_4 = TCPBuilder(Plane=list_item_2.Item1, Speed=panel_22, Zone=panel_21, Command=panel_17, E1="0")  # -> TCP; inputs Plane: list of Plane, Speed: list, Zone: list, Command: list, E1: list; disabled; same code as tcp_builder

tcp_builder_5 = TCPBuilder(Plane=move_4.Geometry, Speed=panel_22, Zone=panel_21, Command=panel_23, E1="0")  # -> TCP; inputs Plane: list of Plane, Speed: list, Zone: list, Command: list, E1: list; disabled; same code as tcp_builder

# ----
number_slider_9 = Slider(12, range=0..180)  # disabled
_20260527中槍新tcp = Plane(Plane(origin=(-239, -410.9711, 197.6248), x=(0, 0, 1), y=(0.8644493132, -0.5027199865, 0)))  # disabled
_20260527中槍新模型 = Mesh(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)  # disabled
xy_plane = XYPlane(Origin=Point(0, 0, 0))  # disabled
mesh_2 = Mesh(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)  # disabled
plane_2 = Plane(Plane(origin=(-234.48, -412.72, 208.373), x=(0, 0, 1), y=(-0.8290384061, 0.5591916677, 0)))  # disabled
rotate_3 = Rotate(Geometry=mesh_2, Angle=degrees(number_slider_9), Plane=PlaneXY(0, 0, 0))  # -> Geometry, Transform; disabled
panel_25 = Panel("10")  # disabled

# ---- group: pln2euler
plane_convert = PlaneConvert(Plane=plane_2, Ref=xy_plane)  # -> Euler, Quat; inputs Plane: Plane, Ref: Plane; disabled
# ---------- plane_convert: Python ----------
#! python3
"""Plane Convert - replaces TACO pln2euler + plane2Quaternion.

Inputs
    Plane : plane to convert
    Ref   : reference plane (empty = World XY)

Outputs
    Euler : x, y, z, rx, ry, rz of Plane in Ref (Euler ZYX, deg, same as Tool Definition)
    Quat  : ABB quaternion q1..q4 (w, x, y, z) of Plane in Ref
"""
import math

import Grasshopper
import Rhino
import Rhino.Geometry as rg


class Script_Instance(Grasshopper.Kernel.GH_ScriptInstance):
    def RunScript(self, Plane: Rhino.Geometry.Plane, Ref: Rhino.Geometry.Plane):
        if Plane is None:
            return None, None
        ref = Ref if Ref is not None else rg.Plane.WorldXY
        pl = rg.Plane(Plane)
        pl.Transform(rg.Transform.PlaneToPlane(ref, rg.Plane.WorldXY))
        r00, r10, r20 = pl.XAxis.X, pl.XAxis.Y, pl.XAxis.Z
        r01, r11, r21 = pl.YAxis.X, pl.YAxis.Y, pl.YAxis.Z
        r22 = pl.ZAxis.Z
        ry = math.asin(max(-1.0, min(1.0, -r20)))
        if abs(r20) < 1 - 1e-9:
            rx, rz = math.atan2(r21, r22), math.atan2(r10, r00)
        else:  # gimbal lock: rx = 0
            rx, rz = 0.0, math.atan2(-r01, r11)
        euler = [pl.OriginX, pl.OriginY, pl.OriginZ] + [math.degrees(a) for a in (rx, ry, rz)]
        q = rg.Quaternion.Rotation(rg.Plane.WorldXY, pl)
        if q.A < 0:
            q = rg.Quaternion(-q.A, -q.B, -q.C, -q.D)
        return [round(v, 4) for v in euler], [q.A, q.B, q.C, q.D]
# ---------- end plane_convert ----------

# ----
panel_26 = Panel(plane_convert.Euler)  # disabled

# ---- group: Tool Definition
tool_definition_py = ToolDefinitionPy(TCP=panel_26, Geometry=rotate_3.Geometry, Weight=panel_25)  # -> Tool, Plane, ToolData; inputs TCP: list of Double, Geometry: Mesh, Weight: Double; disabled
# ---------- tool_definition_py: Python ----------
#! python3
"""Tool Definition - replaces TACO Tool Definition.

Inputs
    TCP      : x, y, z, rx, ry, rz of the TCP in the flange (tool0) frame, mm / deg,
               Euler ZYX like RobotStudio: R = Rz(rz) * Ry(ry) * Rx(rx)
    Geometry : tool mesh in the flange frame (tool axis = +Z), optional
    Weight   : tool mass in kg

Outputs
    Tool     : tool for Path Solver (TCP plane + mass + mesh)
    Plane    : TCP plane in the flange frame
    ToolData : RAPID tooldata declaration
"""
import math

import Grasshopper
import Rhino
import Rhino.Geometry as rg


class ToolDef(object):
    """Path Solver reads plane / quat / mass / mesh."""

    def __init__(self, plane, quat, mass, mesh):
        self.plane, self.quat, self.mass, self.mesh = plane, quat, mass, mesh

    def __repr__(self):
        return "Tool ({:g} kg)".format(self.mass)


def euler_zyx_plane(x, y, z, rx, ry, rz):
    a, b, c = math.radians(rx), math.radians(ry), math.radians(rz)
    ca, sa, cb, sb, cc, sc = math.cos(a), math.sin(a), math.cos(b), math.sin(b), math.cos(c), math.sin(c)
    # columns of Rz(c) * Ry(b) * Rx(a)
    xa = rg.Vector3d(cc * cb, sc * cb, -sb)
    ya = rg.Vector3d(cc * sb * sa - sc * ca, sc * sb * sa + cc * ca, cb * sa)
    return rg.Plane(rg.Point3d(x, y, z), xa, ya)


def euler_zyx_quat(rx, ry, rz):
    """ABB quaternion (w, x, y, z); half-angle form gives the same digits as TACO."""
    cr, sr = math.cos(math.radians(rx) / 2), math.sin(math.radians(rx) / 2)
    cp, sp = math.cos(math.radians(ry) / 2), math.sin(math.radians(ry) / 2)
    cy, sy = math.cos(math.radians(rz) / 2), math.sin(math.radians(rz) / 2)
    q = (cr * cp * cy + sr * sp * sy, sr * cp * cy - cr * sp * sy,
         cr * sp * cy + sr * cp * sy, cr * cp * sy - sr * sp * cy)
    return q if q[0] >= 0 else tuple(-v for v in q)


class Script_Instance(Grasshopper.Kernel.GH_ScriptInstance):
    def RunScript(self,
            TCP: list[float],
            Geometry: Rhino.Geometry.Mesh,
            Weight: float):
        v = list(TCP or [])
        if len(v) < 6:
            ghenv.Component.AddRuntimeMessage(Grasshopper.Kernel.GH_RuntimeMessageLevel.Warning,
                                              "TCP needs 6 numbers: x, y, z, rx, ry, rz")
            return None, None, None
        plane = euler_zyx_plane(*v[:6])
        quat = euler_zyx_quat(*v[3:6])
        mass = float(Weight) if Weight is not None else 10.0
        tool = ToolDef(plane, quat, mass, Geometry)
        tooldata = ("PERS tooldata custom_tool := [TRUE, [[{:.2f},{:.2f},{:.3f}], [{},{},{},{}]], "
                    "[{:g},[0.10,0.00,0.00],[1,0,0,0],0,0,0]];").format(plane.OriginX, plane.OriginY, plane.OriginZ,
                                                                    *(list(quat) + [mass]))
        return tool, plane, tooldata
# ---------- end tool_definition_py ----------

# ---- group: ② 新電池 (Python，取代 TACO) (continued)
merge = Merge(Data1=tcp_builder, Data2=tcp_builder_2, Data3=tcp_builder_3, Data4=tcp_builder_4, Data5=tcp_builder_5)  # disabled

# ---- group: ② 新電池 (Python，取代 TACO) / Deconstruct TCP
tcp_tools = TCPTools(TCP=flatten(merge))  # -> TCP, Target, Speed, RAPID, Zone, E1; inputs TCP: list, Flip: Boolean; disabled
# ---------- tcp_tools: Python ----------
#! python3
"""TCP Tools - replaces TACO Flip TCP + Deconstruct TCP.

Inputs
    TCP  : TCP Builder targets (or plain planes)
    Flip : True = swap X and Y of every plane (Z turns around), like TACO Flip TCP

Outputs
    TCP           : the targets (flipped when Flip is True)
    Target        : planes
    Speed         : speed per target
    RAPID         : extra RAPID line per target (empty = none)
    Zone          : zone per target
    E1            : external axis value per target
"""
import Grasshopper
import Rhino
import Rhino.Geometry as rg


def flip_plane(pl):
    return rg.Plane(pl.Origin, pl.YAxis, pl.XAxis)


class Script_Instance(Grasshopper.Kernel.GH_ScriptInstance):
    def RunScript(self, TCP: list[object], Flip: bool):
        items = [t for t in (TCP or []) if t is not None]
        out = []
        for t in items:
            if hasattr(t, "plane"):
                if Flip:
                    t = type(t)(flip_plane(t.plane), t.speed, t.zone, t.cmd, t.e1)
            elif Flip:
                t = flip_plane(t)
            out.append(t)
        tcp = [t for t in out if hasattr(t, "plane")]
        planes = [t.plane if hasattr(t, "plane") else t for t in out]
        return (out, planes,
                [t.speed for t in tcp], [t.cmd for t in tcp], [t.zone for t in tcp], [t.e1 for t in tcp])
# ---------- end tcp_tools ----------

# ----
number_slider_10 = Slider(88, range=0..3419)  # disabled
boolean_toggle = BooleanToggle(True)  # disabled
button = Button()  # disabled

# ---- group: IK
path_solver = PathSolver(Targets=flatten(merge), Tool=tool_definition_py.Tool, Code=boolean_toggle)  # -> Sim, Joints, Reach, Path, Analysis, Info, RAPID; inputs Targets: list, Speed: list, Cmd: list, Zone: list, E1: list, Base: Plane, Seed: list, Code: Boolean; disabled
# ---------- path_solver: Python ----------
#! python3
"""Path Solver - IRB 2600-20/1.65
Same logic as TACO: TCP targets (robot base frame / WObj0) -> inverse kinematics
-> RAPID module (same format as TACO2). Does not depend on Index, so moving the
Index slider of Robot Pose never re-solves the path.

Inputs
    Targets : TCP Builder > TCP, or plain TCP planes in robot base coordinates
    Speed   : only for plain planes: mm/s (100 -> v100) or speeddata (Deconstruct TCP > Speed)
    Cmd     : only for plain planes: RAPID line after each move (Deconstruct TCP > RAPID)
    Zone    : only for plain planes: fine / 10 (-> z10) / z5 (Deconstruct TCP > Zone)
    E1      : only for plain planes: external axis value (Deconstruct TCP > E1)
    Tool    : Tool Definition > Tool, or a TCP plane in the flange frame. Empty = TACO custom_tool
    Base    : robot base plane in Rhino. Empty = World XY (same as TACO)
    Seed    : 6 joint values (deg) the first target should stay close to
    Code    : False = simulate only, no RAPID (like TACO IK Code). Empty = True

Outputs
    Sim      : solved path for Robot Pose
    Joints   : all joint values, one branch per target
    Reach    : True per target if a solution exists inside the joint limits
    Path     : polyline through all TCP positions
    Analysis : True if every target is reachable and there is no joint flip
    Info     : report
    RAPID    : RAPID module

Joint states (used by Robot Pose for colours)
    grey = ok, orange = near limit, red = at limit / unreachable,
    yellow = wrist singularity (axis 5 ~ 0), magenta = joint flip
"""
import math

import Grasshopper
import Rhino
import Rhino.Geometry as rg
import System.Drawing as sd
from ghpythonlib import treehelpers as th

# IRB 2600-20/1.65 (mm), home pose: all joints 0
D1, A1, A2, A3, D4, D6 = 445.0, 150.0, 700.0, 115.0, 795.0, 85.0
LIMITS = [(-180, 180), (-95, 155), (-180, 75), (-400, 400), (-120, 120), (-400, 400)]
FLIP_DEG = 30.0      # joint change between two targets reported as a flip ...
FLIP_DEG_PER_MM = 0.5  # ... when it is also large compared to the TCP travel (not a travel move)
NEAR_LIMIT_DEG = 10.0  # closer than this to a joint limit -> "near limit"
SINGULAR_DEG = 5.0     # |axis 5| below this -> wrist singularity
CONFDATA_LIKE_TACO = False  # True: write TACO's fixed [-1,0,01,0] instead of the real robconf

COLORS = {
    "ok": sd.Color.FromArgb(170, 170, 170),
    "near limit": sd.Color.FromArgb(255, 150, 0),
    "limit": sd.Color.FromArgb(230, 30, 30),
    "singular": sd.Color.FromArgb(255, 225, 0),
    "flip": sd.Color.FromArgb(220, 40, 220),
}
WIRE_COLOR = sd.Color.FromArgb(150, 0, 0)
SEVERITY = ["ok", "near limit", "singular", "flip", "limit"]

# TACO custom_tool
TOOL_XYZ = (-234.48, -412.72, 208.373)
TOOL_QUAT = (0.6243379406472045, 0.3319670704579113, -0.6243379406472045, 0.3319670704579113)

# joint axes at home pose: (point, direction)
AXES = [
    (rg.Point3d(0, 0, 0), rg.Vector3d.ZAxis),
    (rg.Point3d(A1, 0, D1), rg.Vector3d.YAxis),
    (rg.Point3d(A1, 0, D1 + A2), rg.Vector3d.YAxis),
    (rg.Point3d(0, 0, D1 + A2 + A3), rg.Vector3d.XAxis),
    (rg.Point3d(A1 + D4, 0, D1 + A2 + A3), rg.Vector3d.YAxis),
    (rg.Point3d(0, 0, D1 + A2 + A3), rg.Vector3d.XAxis),
]
# tool0 at home: x = -Z, y = +Y, z = +X
FLANGE_HOME = rg.Plane(rg.Point3d(A1 + D4 + D6, 0, D1 + A2 + A3), -rg.Vector3d.ZAxis, rg.Vector3d.YAxis)
WRIST_HOME = rg.Point3d(A1 + D4, 0, D1 + A2 + A3)
L3 = math.hypot(D4, A3)
PHI = math.atan2(D4, A3)


# ---------- geometry helpers ----------

def quat_plane(xyz, quat):
    w, x, y, z = quat
    n = math.sqrt(w * w + x * x + y * y + z * z)
    w, x, y, z = w / n, x / n, y / n, z / n
    xa = rg.Vector3d(1 - 2 * (y * y + z * z), 2 * (x * y + w * z), 2 * (x * z - w * y))
    ya = rg.Vector3d(2 * (x * y - w * z), 1 - 2 * (x * x + z * z), 2 * (y * z + w * x))
    return rg.Plane(rg.Point3d(*xyz), xa, ya)


def abb_quat(pl):
    q = rg.Quaternion.Rotation(rg.Plane.WorldXY, pl)
    if q.A < 0:
        q = rg.Quaternion(-q.A, -q.B, -q.C, -q.D)
    return q.A, q.B, q.C, q.D


def _rot(pl):
    return [[pl.XAxis.X, pl.YAxis.X, pl.ZAxis.X],
            [pl.XAxis.Y, pl.YAxis.Y, pl.ZAxis.Y],
            [pl.XAxis.Z, pl.YAxis.Z, pl.ZAxis.Z]]


def _mul(a, b):
    return [[sum(a[i][k] * b[k][j] for k in range(3)) for j in range(3)] for i in range(3)]


def _tr(a):
    return [[a[j][i] for j in range(3)] for i in range(3)]


def _rz(t):
    c, s = math.cos(t), math.sin(t)
    return [[c, -s, 0], [s, c, 0], [0, 0, 1]]


def _ry(t):
    c, s = math.cos(t), math.sin(t)
    return [[c, 0, s], [0, 1, 0], [-s, 0, c]]


R_HOME_T = _tr(_rot(FLANGE_HOME))


# ---------- kinematics ----------

def link_transforms(q):
    """Cumulative transform of link 1..6 for joints q (deg)."""
    xs, t = [], rg.Transform.Identity
    for (p, d), a in zip(AXES, q):
        t = t * rg.Transform.Rotation(math.radians(a), d, p)
        xs.append(t)
    return xs


def fk(q, tool):
    pl = rg.Plane(tool)
    pl.Transform(link_transforms(q)[-1] * rg.Transform.PlaneToPlane(rg.Plane.WorldXY, FLANGE_HOME))
    return pl


def flange_from_tcp(tcp, tool):
    pl = rg.Plane(rg.Plane.WorldXY)
    pl.Transform(rg.Transform.PlaneToPlane(rg.Plane.WorldXY, tcp) * rg.Transform.PlaneToPlane(tool, rg.Plane.WorldXY))
    return pl


def ik_all(flange):
    """All analytic solutions (deg, wrapped to [-180, 180)) for a flange plane."""
    w = flange.Origin - flange.ZAxis * D6
    rho = math.hypot(w.X, w.Y)
    s = w.Z - D1
    base = math.atan2(w.Y, w.X)
    sols = []
    for q1, r in ((base, rho - A1), (base + math.pi, -rho - A1)):
        c3 = (r * r + s * s - A2 * A2 - L3 * L3) / (2 * A2 * L3)
        if abs(c3) > 1:
            continue
        for e in (1, -1):
            q3 = e * math.acos(c3) - PHI
            px = D4 * math.cos(q3) + A3 * math.sin(q3)
            pz = A2 - D4 * math.sin(q3) + A3 * math.cos(q3)
            q2 = math.atan2(pz, px) - math.atan2(s, r)
            m = _mul(_mul(_tr(_mul(_rz(q1), _ry(q2 + q3))), _rot(flange)), R_HOME_T)
            cb = max(-1.0, min(1.0, m[0][0]))
            for f in (1, -1):
                q5 = f * math.acos(cb)
                if abs(math.sin(q5)) < 1e-9:  # wrist singularity: only q4 + q6 is defined
                    q4, q6 = 0.0, math.atan2(m[2][1], m[1][1])
                else:
                    q4 = math.atan2(f * m[1][0], -f * m[2][0])
                    q6 = math.atan2(f * m[0][1], f * m[0][2])
                sols.append([(math.degrees(v) + 180) % 360 - 180 for v in (q1, q2, q3, q4, q5, q6)])
    return sols


def _variants(sol):
    """Solution plus the +-360 turns of axis 4 and 6 that stay inside the limits."""
    out = []
    for d4 in (-360, 0, 360):
        for d6 in (-360, 0, 360):
            q = list(sol)
            q[3] += d4
            q[5] += d6
            if all(lo <= a <= hi for a, (lo, hi) in zip(q, LIMITS)):
                out.append(q)
    return out


def _cost(q, prev):
    return sum(w * (a - b) ** 2 for w, a, b in zip((1, 1, 1, 0.5, 0.5, 0.25), q, prev))


def solve_path(targets, tool, seed):
    """Joint values per target (None if unreachable), closest to the previous pose."""
    joints, prev = [], seed
    for tp in targets:
        cands = [v for s in ik_all(flange_from_tcp(tp, tool)) for v in _variants(s)]
        if not cands:
            joints.append(None)
            continue
        q = min(cands, key=lambda c: _cost(c, prev))
        joints.append(q)
        prev = q
    return joints


def confdata(q):
    """ABB robconf [cf1, cf4, cf6, cfx]."""
    xs = link_transforms(q)
    wrist = rg.Point3d(WRIST_HOME)
    wrist.Transform(xs[2])
    shoulder = rg.Point3d(A1, 0, D1)
    shoulder.Transform(xs[0])
    lower_arm = rg.Vector3d(rg.Vector3d.ZAxis)
    lower_arm.Transform(xs[1])
    fwd = rg.Vector3d(math.cos(math.radians(q[0])), math.sin(math.radians(q[0])), 0)
    behind_axis1 = wrist.X * fwd.X + wrist.Y * fwd.Y < 0
    v = wrist - shoulder
    behind_lower_arm = (v * fwd) * lower_arm.Z - v.Z * (lower_arm * fwd) < 0
    cfx = 4 * behind_axis1 + 2 * behind_lower_arm + (q[4] < 0)
    return [int(math.floor(q[0] / 90.0)), int(math.floor(q[3] / 90.0)), int(math.floor(q[5] / 90.0)), cfx]


def joint_status(q, prev_q, is_flip):
    """State of each joint: ok / near limit / limit / singular / flip."""
    out = []
    for j, (a, (lo, hi)) in enumerate(zip(q, LIMITS)):
        s = "ok"
        if min(a - lo, hi - a) < NEAR_LIMIT_DEG:
            s = "near limit"
        if j == 4 and abs(a) < SINGULAR_DEG:
            s = "singular"
        if is_flip and prev_q is not None and abs(a - prev_q[j]) > FLIP_DEG:
            s = "flip"
        if a <= lo or a >= hi:
            s = "limit"
        out.append(s)
    return out


# ---------- RAPID ----------

def _item(lst, i, default):
    if not lst:
        return default
    v = lst[min(i, len(lst) - 1)]
    v = "" if v is None else str(v).strip()
    return default if v in ("", "NULL", "None") else v


def _is_number(v):
    return v.replace(".", "", 1).isdigit()


def _speed(v):
    return "v" + v if _is_number(v) else v


def _zone(z):
    return "z" + z if _is_number(z) else z


def rapid_module(targets, joints, tool, tool_quat, mass, speed, extra, zone, e1):
    tq = tool_quat
    lines = [
        "! TACO Target Robot: T_ROB1",
        "MODULE TACO2",
        "PERS tooldata custom_tool := [TRUE, [[{:.2f},{:.2f},{:.3f}], [{},{},{},{}]], "
        "[{:g},[0.10,0.00,0.00],[1,0,0,0],0,0,0]];".format(tool.Origin.X, tool.Origin.Y, tool.Origin.Z,
                                                          *(list(tq) + [mass])),
        "PROC Main()",
        "ConfL \\Off;",
        "ConfJ \\Off;",
    ]
    for i, (tp, q) in enumerate(zip(targets, joints)):
        cf = ["-1", "0", "01", "0"] if CONFDATA_LIKE_TACO else (confdata(q) if q else [0, 0, 0, 0])
        lines.append(
            "MoveL [[{:.2f},{:.2f},{:.2f}],[{:.4f},{:.4f},{:.4f},{:.4f}],[{},{},{},{}],[{},9E9,9E9,9E9,9E9,9E9]],"
            "{},{},custom_tool\\WObj:=WObj0;".format(
                tp.Origin.X, tp.Origin.Y, tp.Origin.Z, *(list(abb_quat(tp)) + cf),
                _item(e1, i, "9E9"), _speed(_item(speed, i, "100")), _zone(_item(zone, i, "fine"))))
        x = _item(extra, i, "")
        if x:
            lines.append(x)
    lines += ["ENDPROC", "ENDMODULE"]
    return "\n".join(lines)


# ---------- solved path ----------

class Simulation(object):
    """Everything Robot Pose needs that does not depend on Index."""

    colors = COLORS
    wire_color = WIRE_COLOR
    severity = SEVERITY

    def __init__(self, targets, joints, tool, base, tool_mesh=None, e1=None):
        self.joints = joints
        self.tool = tool
        self.tool_mesh = tool_mesh  # in the flange frame
        self.e1 = e1 or []
        self.to_world = rg.Transform.PlaneToPlane(rg.Plane.WorldXY, base)
        self.points = []
        for t in targets:
            p = rg.Point3d(t.Origin)
            p.Transform(self.to_world)
            self.points.append(p)

        self.unreachable = [i for i, q in enumerate(joints) if q is None]
        self.flips, self.prev_of = [], {}
        last = None
        for i, q in enumerate(joints):
            if q is None:
                continue
            if last is not None:
                self.prev_of[i] = last
                dq = max(abs(a - b) for a, b in zip(q, joints[last]))
                if dq > FLIP_DEG and dq > FLIP_DEG_PER_MM * targets[i].Origin.DistanceTo(targets[last].Origin):
                    self.flips.append(i)
            last = i
        self.flip_set = set(self.flips)
        self.near = [i for i, q in enumerate(joints)
                     if q and any(min(a - lo, hi - a) < NEAR_LIMIT_DEG for a, (lo, hi) in zip(q, LIMITS))]
        self.singular = [i for i, q in enumerate(joints) if q and abs(q[4]) < SINGULAR_DEG]
        self.marks = ([(self.points[i], COLORS["limit"]) for i in self.unreachable[:2000]] +
                      [(self.points[i], COLORS["flip"]) for i in self.flips[:2000]])
        self.bbox = rg.BoundingBox(self.points)

    def __len__(self):
        return len(self.joints)

    def __repr__(self):
        return "Simulation ({} targets)".format(len(self.joints))

    def pose(self, index):
        """(index, shown index, joints, status per joint, reachable) for a target.
        An unreachable target shows the last reachable pose before it."""
        idx = max(0, min(int(index), len(self.joints) - 1))
        shown = next((k for k in range(idx, -1, -1) if self.joints[k] is not None),
                     next((k for k, j in enumerate(self.joints) if j is not None), None))
        if shown is None:
            return idx, None, None, ["limit"] * 6, False
        q = self.joints[shown]
        if shown != idx:
            return idx, shown, q, ["limit"] * 6, False
        prev_q = self.joints[self.prev_of[idx]] if idx in self.prev_of else None
        return idx, shown, q, joint_status(q, prev_q, idx in self.flip_set), True

    def link_transforms(self, q):
        return [self.to_world * x for x in link_transforms(q)]

    def tool_transform(self, q):
        """Flange frame -> world for joints q (to place the tool mesh)."""
        return self.to_world * link_transforms(q)[-1] * rg.Transform.PlaneToPlane(rg.Plane.WorldXY, FLANGE_HOME)

    def tcp(self, q):
        pl = fk(q, self.tool)
        pl.Transform(self.to_world)
        return pl

    def summary(self):
        return "path: {} unreachable, {} flips, {} near limit, {} singular".format(
            len(self.unreachable), len(self.flips), len(self.near), len(self.singular))


# ---------- component ----------

class Script_Instance(Grasshopper.Kernel.GH_ScriptInstance):
    def RunScript(self,
            Targets: list[object],
            Speed: list[object],
            Cmd: list[object],
            Zone: list[object],
            E1: list[object],
            Tool,
            Base: Rhino.Geometry.Plane,
            Seed: list[object],
            Code: bool):
        items = [t for t in (Targets or []) if t is not None]
        if not items:
            return [None] * 7
        if all(hasattr(t, "plane") for t in items):  # TCP Builder targets
            targets = [t.plane for t in items]
            speed, cmd, zone = [t.speed for t in items], [t.cmd for t in items], [t.zone for t in items]
            e1 = ["{:g}".format(t.e1) for t in items]
        else:
            targets, speed, cmd, zone, e1 = items, Speed, Cmd, Zone, E1

        if hasattr(Tool, "plane"):  # Tool Definition
            tool, tool_quat, mass, tool_mesh = Tool.plane, Tool.quat, Tool.mass, Tool.mesh
        elif isinstance(Tool, rg.Plane):
            tool, tool_quat, mass, tool_mesh = Tool, abb_quat(Tool), 10.0, None
        else:
            tool, tool_quat, mass, tool_mesh = quat_plane(TOOL_XYZ, TOOL_QUAT), TOOL_QUAT, 10.0, None
        base = Base if Base is not None else rg.Plane.WorldXY
        seed = list(Seed)[:6] if Seed and len(Seed) >= 6 else [0, 0, 0, 0, 30, 0]

        joints = solve_path(targets, tool, seed)
        code = rapid_module(targets, joints, tool, tool_quat, mass, speed, cmd, zone, e1) if Code is not False else None
        sim = Simulation(targets, joints, tool, base, tool_mesh, [_item(e1, i, "0") for i in range(len(targets))])

        info = [
            "targets: {}".format(len(targets)),
            "unreachable: {}{}".format(len(sim.unreachable), " " + str(sim.unreachable[:20]) if sim.unreachable else ""),
            "joint flips > {} deg: {}{}".format(FLIP_DEG, len(sim.flips), " " + str(sim.flips[:20]) if sim.flips else ""),
            "near limit (< {} deg): {}".format(NEAR_LIMIT_DEG, len(sim.near)),
            "wrist singular (|A5| < {} deg): {}".format(SINGULAR_DEG, len(sim.singular)),
            "RAPID: {}".format("off (Code = False)" if code is None else "{} lines".format(code.count("\n") + 1)),
        ]
        if sim.unreachable:
            ghenv.Component.AddRuntimeMessage(Grasshopper.Kernel.GH_RuntimeMessageLevel.Warning,
                                              "{} target(s) unreachable".format(len(sim.unreachable)))
        if sim.flips:
            ghenv.Component.AddRuntimeMessage(Grasshopper.Kernel.GH_RuntimeMessageLevel.Remark,
                                              "{} joint flip(s) > {} deg".format(len(sim.flips), FLIP_DEG))

        joint_tree = th.list_to_tree([j if j is not None else [] for j in joints])
        reach = [j is not None for j in joints]
        path = rg.Polyline(sim.points).ToPolylineCurve() if len(sim.points) > 1 else None
        analysis = not sim.unreachable and not sim.flips
        return sim, joint_tree, reach, path, analysis, "\n".join(info), code
# ---------- end path_solver ----------

# ---- group: Display Robot
robot_pose = RobotPose(Sim=path_solver.Sim, Meshes=irb2600_home_meshes, Index=number_slider_10)  # -> Robot, TCP, Axis, AxisText, Status; inputs Meshes: list of Mesh, Index: Int32; disabled
# ---------- robot_pose: Python ----------
#! python3
"""Robot Pose - shows the Path Solver result at one target. Only this component
runs when the Index slider moves.

Inputs
    Sim    : Path Solver > Sim
    Meshes : robot meshes in home pose: base, link1..link6, then tool mesh(es).
             If Path Solver got a Tool Definition with Geometry, that tool mesh is
             used and meshes after link6 are ignored.
    Index  : target to display

Outputs
    Robot    : meshes posed at Index, vertex-coloured by joint status
    TCP      : TCP plane at Index
    Axis     : 6 joint values at Index (deg)
    AxisText : TACO Display Robot format "a1;a2;a3;a4;a5;a6;e1;e2;reachable"
    Status   : joint states at Index

Preview (TACO style): grey robot with mesh edges, each link coloured by the state
of its joint, joint values top-left, unreachable (red) / flip (magenta) targets on
the path.
"""
import Grasshopper
import Rhino
import Rhino.Geometry as rg
import System.Drawing as sd


class Script_Instance(Grasshopper.Kernel.GH_ScriptInstance):
    def __init__(self):
        self._draw = []   # (mesh, colour)
        self._marks = []  # (point, colour)
        self._hud = []    # (text, colour)
        self._bbox = rg.BoundingBox.Empty
        self._wire = sd.Color.Black

    def RunScript(self, Sim, Meshes: list[Rhino.Geometry.Mesh], Index: int):
        self._draw, self._marks, self._hud = [], [], []
        self._bbox = rg.BoundingBox.Empty
        if Sim is None:
            return None, None, None, None, None
        colors = Sim.colors
        self._wire = Sim.wire_color

        idx, shown, q, status, reachable = Sim.pose(Index or 0)
        robot, tcp = [], None
        if q is not None:
            xs = Sim.link_transforms(q)
            meshes = [(m, Sim.to_world if i == 0 else xs[min(i, 6) - 1]) for i, m in enumerate(Meshes or [])]
            if Sim.tool_mesh is not None:
                meshes = meshes[:7] + [(Sim.tool_mesh, Sim.tool_transform(q))]
            for i, (m, xf) in enumerate(meshes):
                if m is None:
                    continue
                dup = m.DuplicateMesh()
                dup.Transform(xf)
                colour = colors["ok"] if i == 0 and reachable else colors[status[min(max(i, 1), 6) - 1]]
                dup.VertexColors.CreateMonotoneMesh(colour)
                robot.append(dup)
                self._draw.append((dup, colour))
                self._bbox = rg.BoundingBox.Union(self._bbox, dup.GetBoundingBox(False))
            tcp = Sim.tcp(q)

        self._marks = Sim.marks + [(Sim.points[idx], sd.Color.Black)]
        self._bbox = rg.BoundingBox.Union(self._bbox, Sim.bbox)

        self._hud.append(("PATH SIM  IRB 2600-20/1.65", sd.Color.FromArgb(0, 70, 200)))
        self._hud.append(("index {} / {}".format(idx, len(Sim) - 1), sd.Color.Black))
        if not reachable:
            self._hud.append(("UNREACHABLE  (showing index {})".format(shown), colors["limit"]))
        else:
            for j, (a, s) in enumerate(zip(q, status)):
                self._hud.append(("A{} {:9.2f}  {}".format(j + 1, a, "" if s == "ok" else s),
                                  sd.Color.Black if s == "ok" else colors[s]))
        bad = Sim.unreachable or Sim.flips
        self._hud.append((Sim.summary(), colors["limit"] if bad else sd.Color.DimGray))

        worst = "limit" if not reachable else max(status, key=Sim.severity.index)
        if worst != "ok":
            ghenv.Component.AddRuntimeMessage(Grasshopper.Kernel.GH_RuntimeMessageLevel.Remark,
                                              "index {}: {}".format(idx, worst))
        axis = q if reachable else []
        e1 = Sim.e1[idx] if idx < len(Sim.e1) else "0"
        axis_text = ";".join(["{:.2f}".format(a) for a in (q or [0] * 6)] + [str(e1), "0", str(bool(reachable)).lower()])
        status_text = ["A{} {}".format(j + 1, s) for j, s in enumerate(status)]
        return robot, tcp, axis, axis_text, status_text

    # ---------- preview ----------

    def get_ClippingBox(self):
        return self._bbox

    def DrawViewportMeshes(self, args):
        for m, c in self._draw:
            args.Display.DrawMeshShaded(m, Rhino.Display.DisplayMaterial(c))

    def DrawViewportWires(self, args):
        for m, c in self._draw:
            args.Display.DrawMeshWires(m, self._wire)
        for p, c in self._marks:
            args.Display.DrawPoint(p, Rhino.Display.PointStyle.RoundSimple, 7, c)
        y = 90
        for text, c in self._hud:
            args.Display.Draw2dText(text, c, rg.Point2d(20, y), False, 15, "Consolas")
            y += 20
# ---------- end robot_pose ----------

# ---- group: ② 新電池 (Python，取代 TACO) (continued)
polyline_3 = PolyLine(Vertices=tcp_tools.Target, Closed=False)  # disabled
index_hud = IndexHUD(Index=number_slider_10, Sim=path_solver.Sim)  # -> Info; inputs Index: Int32, Duration: Double, Color: Color; disabled
# ---------- index_hud: Python ----------
#! python3
"""Index HUD - playback bar in the Rhino viewport for the Index slider (like TACO SliderHUD).

In the viewport: click the play button to play / pause, click or drag on the bar to jump.

Inputs
    Index    : connect the Index slider (the same slider that drives Robot Pose)
    Sim      : Path Solver > Sim (optional) - the slider range follows the number of targets
    Duration : seconds to play the whole path (empty = 30)
    Color    : bar colour (empty = blue)

Output
    Info     : state of the HUD
"""
import Grasshopper
import Rhino
import System
import System.Drawing as sd
import Eto.Forms as ef
import scriptcontext as sc

KEY = "index_hud_"
FPS = 30.0
BOTTOM_OFFSET = 95  # px above the viewport bottom, clear of the TACO SliderHUD bar


def _value(slider):
    return int(round(float(str(slider.CurrentValue))))


def _range(slider):
    return int(round(float(str(slider.Slider.Minimum)))), int(round(float(str(slider.Slider.Maximum))))


class HudMouse(Rhino.UI.MouseCallback):
    def __init__(self, hud):
        super().__init__()
        self.hud = hud

    def OnMouseDown(self, e):
        if e.MouseButton == Rhino.UI.MouseButton.Left and self.hud.mouse_down(e.View.ActiveViewport, e.ViewportPoint):
            e.Cancel = True

    def OnMouseMove(self, e):
        if self.hud.dragging:
            self.hud.jump_to(e.View.ActiveViewport, e.ViewportPoint.X)
            e.Cancel = True

    def OnMouseUp(self, e):
        if self.hud.dragging:
            self.hud.dragging = False
            e.Cancel = True


class SliderHud(Rhino.Display.DisplayConduit):
    def __init__(self):
        super().__init__()
        self.comp = None
        self.slider = None
        self.colour = sd.Color.FromArgb(90, 110, 255)
        self.duration = 30.0
        self.playing = False
        self.dragging = False
        self.play_start, self.play_from = System.DateTime.Now, 0
        self.mouse = HudMouse(self)
        self.timer = ef.UITimer()
        self.timer.Interval = 1.0 / FPS
        self.timer.Elapsed += self._tick

    # ---------- state ----------

    def bind(self, comp, slider, duration, colour):
        self.comp, self.slider = comp, slider
        self.duration = duration if duration and duration > 0 else 30.0
        self.colour = colour if colour is not None and not colour.IsEmpty else sd.Color.FromArgb(90, 110, 255)
        self.Enabled = True
        self.mouse.Enabled = True
        if not self.timer.Started:
            self.timer.Start()

    def shutdown(self):
        self.playing = self.dragging = False
        try:
            self.timer.Stop()
        except Exception:
            pass
        self.mouse.Enabled = False
        self.Enabled = False
        Rhino.RhinoDoc.ActiveDoc.Views.Redraw()

    def alive(self):
        ok = (self.comp is not None and self.slider is not None and self.comp.OnPingDocument() is not None
              and not self.comp.Locked and self.slider.OnPingDocument() is not None)
        if not ok:
            self.shutdown()
        return ok

    def set_value(self, v):
        lo, hi = _range(self.slider)
        v = max(lo, min(hi, int(v)))
        if v != _value(self.slider):
            self.slider.SetSliderValue(System.Decimal(v))
            self.slider.ExpireSolution(True)

    # ---------- layout / drawing ----------

    def layout(self, vp):
        b = vp.Bounds
        y = b.Bottom - BOTTOM_OFFSET
        play = sd.Rectangle(b.Left + 16, y - 15, 30, 30)
        return play, b.Left + 64, b.Right - 110, y

    def DrawForeground(self, e):
        if not self.alive():
            return
        play, x0, x1, y = self.layout(e.Viewport)
        lo, hi = _range(self.slider)
        v = _value(self.slider)
        t = 0.0 if hi <= lo else (v - lo) / float(hi - lo)
        hx = int(x0 + t * (x1 - x0))
        d = e.Display
        faint = sd.Color.FromArgb(110, self.colour)
        d.Draw2dLine(sd.Point(x0, y), sd.Point(x1, y), faint, 3)
        d.Draw2dLine(sd.Point(x0, y), sd.Point(hx, y), self.colour, 5)
        d.Draw2dRectangle(sd.Rectangle(hx - 5, y - 11, 10, 22), self.colour, 1, self.colour)
        d.Draw2dRectangle(play, self.colour, 2, sd.Color.FromArgb(40, self.colour))
        d.Draw2dText("❚❚" if self.playing else "▶", self.colour,
                     Rhino.Geometry.Point2d(play.Left + play.Width / 2.0, play.Top + play.Height / 2.0), True, 18)
        d.Draw2dText(str(v), self.colour, Rhino.Geometry.Point2d(x1 + 14, y - 14), False, 22)
        d.Draw2dText("/ {}  ({:g}s)".format(hi, self.duration), self.colour, Rhino.Geometry.Point2d(x1 + 14, y + 10), False, 11)

    # ---------- interaction ----------

    def mouse_down(self, vp, pt):
        if not self.alive():
            return False
        play, x0, x1, y = self.layout(vp)
        if play.Contains(pt):
            lo, hi = _range(self.slider)
            if not self.playing and _value(self.slider) >= hi:
                self.set_value(lo)  # restart from the beginning
            self.playing = not self.playing
            self.play_start, self.play_from = System.DateTime.Now, _value(self.slider)
            Rhino.RhinoDoc.ActiveDoc.Views.Redraw()
            return True
        if x0 - 8 <= pt.X <= x1 + 8 and abs(pt.Y - y) <= 14:
            self.playing = False
            self.dragging = True
            self.jump_to(vp, pt.X)
            return True
        return False

    def jump_to(self, vp, x):
        _play, x0, x1, _y = self.layout(vp)
        lo, hi = _range(self.slider)
        t = min(1.0, max(0.0, (x - x0) / float(max(1, x1 - x0))))
        self.set_value(round(lo + t * (hi - lo)))

    def _tick(self, sender, e):
        if not self.playing or not self.alive():
            return
        # position from elapsed time, so the whole path takes Duration seconds however slow redraws are
        lo, hi = _range(self.slider)
        elapsed = (System.DateTime.Now - self.play_start).TotalSeconds
        v = self.play_from + int(elapsed / self.duration * (hi - lo))
        if v >= hi:
            v, self.playing = hi, False
        self.set_value(v)


def _fit_slider(slider, last):
    """Slider range follows the path length (done after the solution, not during it)."""
    def fit(doc):
        slider.Slider.Maximum = System.Decimal(last)
        if _value(slider) > last:
            slider.SetSliderValue(System.Decimal(last))
        slider.ExpireSolution(False)
    return fit


class Script_Instance(Grasshopper.Kernel.GH_ScriptInstance):
    def RunScript(self,
            Index: int,
            Sim,
            Duration: float,
            Color: System.Drawing.Color):
        comp = ghenv.Component
        sliders = [s for s in comp.Params.Input[0].Sources if isinstance(s, Grasshopper.Kernel.Special.GH_NumberSlider)]
        key = KEY + str(comp.InstanceGuid)
        hud = sc.sticky.get(key)
        if hud is not None and type(hud) is not SliderHud:  # left over from an older version of this script
            try:
                hud.shutdown()
            except Exception:
                pass
            hud = None
        if not sliders:
            if hud is not None:
                hud.shutdown()
            return "connect the Index slider to Index"
        if hud is None:
            hud = SliderHud()
            sc.sticky[key] = hud
        slider = sliders[0]
        hud.bind(comp, slider, Duration, Color)

        if Sim is not None and len(Sim) > 0:
            lo, hi = _range(slider)
            if hi != len(Sim) - 1:
                comp.OnPingDocument().ScheduleSolution(
                    5, Grasshopper.Kernel.GH_Document.GH_ScheduleDelegate(_fit_slider(slider, len(Sim) - 1)))
        lo, hi = _range(slider)
        return "HUD on: slider '{}' {}..{}, {:g}s for the whole path".format(slider.NickName, lo, hi, hud.duration)
# ---------- end index_hud ----------
robot_colour_preview = RobotColourPreview(Robot=robot_pose.Robot)  # -> Count; inputs Robot: list of Mesh; disabled
# ---------- robot_colour_preview: Python ----------
#! python3
"""Robot Colour Preview
Draws the Path Simulator robot shaded in its joint-status colours, without mesh edges.
Robot : Path Simulator > Robot (vertex-coloured meshes)
Count : number of meshes drawn
"""
import Grasshopper
import Rhino
import Rhino.Geometry as rg


class Script_Instance(Grasshopper.Kernel.GH_ScriptInstance):
    def __init__(self):
        self._draw = []
        self._bbox = rg.BoundingBox.Empty

    def RunScript(self, Robot: list[Rhino.Geometry.Mesh]):
        self._draw = []
        self._bbox = rg.BoundingBox.Empty
        for m in Robot or []:
            if m is None or m.VertexColors.Count == 0:
                continue
            self._draw.append((m, Rhino.Display.DisplayMaterial(m.VertexColors[0])))
            self._bbox = rg.BoundingBox.Union(self._bbox, m.GetBoundingBox(False))
        return len(self._draw)

    def get_ClippingBox(self):
        return self._bbox

    def DrawViewportMeshes(self, args):
        for m, mat in self._draw:
            args.Display.DrawMeshShaded(m, mat)
# ---------- end robot_colour_preview ----------

# ---- group: ABB IRC5 Stream
irc5_upload = IRC5Upload(RAPID=path_solver.RAPID, Upload=button, Run=run, Stop=stop)  # -> Info, Controllers; inputs Controller: String, RAPID: String, Task: String, Upload: Boolean, Run: Boolean, Stop: Boolean; disabled
# ---------- irc5_upload: Python ----------
#! python3
"""IRC5 Upload - replaces the TACO IRC5 Stream cluster (Taco2.dll), using the ABB PC SDK.
Unlike TACO it does not clear the controller event log, so it does not need that grant.

Inputs
    Controller : system name or IP (empty = first controller found on the network)
    RAPID      : RAPID module text (Path Solver > RAPID)
    Task       : RAPID task (empty = T_ROB1)
    Upload     : True = load the module into the task (replaces a module with the same name)
    Run        : True = start RAPID from main (controller in Auto, motors on)
    Stop       : True = stop RAPID

Outputs
    Info        : log of the last action
    Controllers : controllers found on the network
"""
import os
import re
import tempfile

import clr
import Grasshopper

SDK = os.path.expandvars(r"%APPDATA%\Grasshopper\UserObjects\ABB.Robotics.Controllers.PC.dll")
clr.AddReference(SDK)
from ABB.Robotics.Controllers import ControllerFactory, Mastership, UserInfo  # noqa: E402
from ABB.Robotics.Controllers.Discovery import NetworkScanner  # noqa: E402
from ABB.Robotics.Controllers.RapidDomain import ExecutionMode, RapidLoadMode, RegainMode, StopMode  # noqa: E402


def scan():
    s = NetworkScanner()
    s.Scan()
    return list(s.Controllers)


def pick(infos, name):
    if not infos:
        raise RuntimeError("no controller found (network cable / RobotStudio virtual controller running?)")
    if not name:
        if len(infos) > 1:  # never guess which robot gets the program
            raise RuntimeError("{} controllers found ({}): set Controller to the system name".format(
                len(infos), ", ".join(i.SystemName for i in infos)))
        return infos[0]
    for i in infos:
        if name in (i.SystemName, str(i.IPAddress), i.ControllerName):
            return i
    raise RuntimeError("controller '{}' not found".format(name))


def connect(info):
    c = ControllerFactory.CreateFrom(info)
    c.Logon(UserInfo.DefaultUser)
    return c


def upload(c, task_name, code, log):
    m = re.search(r"^\s*MODULE\s+(\w+)", code, re.M)
    module = m.group(1) if m else "TACO2"
    local = os.path.join(tempfile.gettempdir(), module + ".mod")
    with open(local, "w", newline="\r\n") as f:
        f.write(code)
    remote = module + ".mod"
    c.FileSystem.PutFile(local, remote, True)
    log.append("copied {} ({} lines) to {}".format(remote, code.count("\n") + 1, c.FileSystem.RemoteDirectory))
    with Mastership.Request(c.Rapid):
        task = c.Rapid.GetTask(task_name)
        task.LoadModuleFromFile(c.FileSystem.RemoteDirectory + "/" + remote, RapidLoadMode.Replace)
        task.ResetProgramPointer()
    log.append("loaded module {} into {}, program pointer to main".format(module, task_name))


def run(c, log):
    with Mastership.Request(c.Rapid):
        c.Rapid.Start(RegainMode.Continue, ExecutionMode.Continuous)
    log.append("RAPID started")


def stop(c, log):
    with Mastership.Request(c.Rapid):
        c.Rapid.Stop(StopMode.Immediate)
    log.append("RAPID stopped")


class Script_Instance(Grasshopper.Kernel.GH_ScriptInstance):
    def RunScript(self,
            Controller: str,
            RAPID: str,
            Task: str,
            Upload: bool,
            Run: bool,
            Stop: bool):
        log = []
        try:
            infos = scan()
        except Exception as ex:
            return "scan failed: {}".format(ex), []
        found = ["{} ({}){}".format(i.SystemName, i.IPAddress, " virtual" if i.IsVirtual else "") for i in infos]
        if not (Upload or Run or Stop):
            return "idle - press Upload / Run / Stop", found

        c = None
        try:
            info = pick(infos, (Controller or "").strip())
            c = connect(info)
            log.append("connected to {} ({}), mode {}, state {}".format(
                info.SystemName, info.IPAddress, c.OperatingMode, c.State))
            if Stop:
                stop(c, log)
            if Upload:
                if not RAPID:
                    raise RuntimeError("RAPID is empty (Path Solver Code = False?)")
                upload(c, (Task or "T_ROB1").strip(), RAPID, log)
            if Run:
                run(c, log)
        except Exception as ex:
            log.append("ERROR: {}".format(ex))
            ghenv.Component.AddRuntimeMessage(Grasshopper.Kernel.GH_RuntimeMessageLevel.Warning, str(ex)[:200])
        finally:
            if c is not None:
                try:
                    c.Logoff()
                finally:
                    c.Dispose()
        return "\n".join(log), found
# ---------- end irc5_upload ----------

# ----
panel_27 = Panel(path_solver.Analysis)  # disabled
panel_28 = Panel(irc5_upload.Info)  # disabled
